# Grasshopper definition ABxM CrossSectionAgents Karamba3d.gh (Grasshopper 1.0.7)
# plug-ins: HygroDesign, ABxM.Grasshopper, Karamba3D, LunchBox, sof_gh_sofistik-2022

io = IO(
    SofistikDocumentProperties_VersionMajor="2022",
    SofistikDocumentProperties_VersionMinor="0",
    SofistikDocumentProperties_VersionName="2022")
number_slider = Slider(5, range=0..10)
dup = DuplicateData(Data=Slider(-0.1, range=-1..1), Number=expr("x-2", number_slider), Order=True)
series = Series(Start=0, Step=Slider(0.5, range=0..1), Count=number_slider)
merge = Merge(Data1=flatten("0"), Data2=flatten(dup), Data3=flatten("0"))
pt = ConstructPoint(XCoordinate=series, YCoordinate=0, ZCoordinate=merge)
data = Data(pt)
lng = ListLength(List=data)  # -> expr("x-2", Length)
board_width = Slider(0.15, range=0.1..0.5)
dom = ConstructDomain(DomainStart=1, DomainEnd=lng)
c_script = CSharpScript(Reference=["C:\Users\Alex Reiner\AppData\Roaming\Grasshopper\Libraries\ABxM.Core.dll", "C:\Users\Alex Reiner\AppData\Roaming\Grasshopper\Libraries\HygroDesign.Core.dll"])  # -> out, oBehaviour
# ---------- c_script: C# usings ----------
using ABxM.Core;
using ABxM.Core.Agent;
using ABxM.Core.Behavior;

using HygroDesign.Core;
# ---------- c_script: C# ----------
    oBehaviour = endBehaviour;
# ---------- c_script: C# additional code ----------
  EndBehaviour endBehaviour = new EndBehaviour();

  public class EndBehaviour : BehaviorBase
  {
    public EndBehaviour()
    {
    }

    public override void Execute(AgentBase agent)
    {
      //initialization
      CrossSectionAgent CSAgent = agent as CrossSectionAgent;

      CSAgent.Moves.Clear();
      CSAgent.Weights.Clear();

      return;
    }
  }
# ---------- end c_script ----------
nurbs = NurbsCurve(Vertices=pt, Degree=3, Periodic=False)  # -> reparameterize(Curve), Length, Domain
item = ListItem(List=reverse(data), Index=0, Wrap=True)
subset = SubList(List=data, Domain=dom, Wrap=True)  # -> List, Index
item_2 = ListItem(List=data, Index=0, Wrap=True)
dqltraining = DQLTrainingBehaviour(Perception=Slider(2, range=0..10))
geo = Geometry(nurbs.Curve)
crosec = CrossSectionFromNurbsCurve(NurbsCurve=geo, BoardWidth=board_width)
merge_2 = Merge(Data1=item_2, Data2=item)
merge_3 = Merge(Data1=dqltraining, Data2=c_script.oBehaviour)
agent = CrossSectionAgent(StartingPoint=merge_2, Behaviours=merge_3)  # -> flatten(CrossSectionAgent)
agent_2 = CrossSectionAgent(StartingPoint=subset.List, Behaviours=dqltraining)  # -> flatten(CrossSectionAgent)
item_3 = ListItem(List=agent, Index=0, Wrap=True)  # -> Item, Item1
merge_4 = Merge(Data1=flatten(item_3.Item), Data2=flatten(agent_2), Data3=flatten(item_3.Item1))
agentsystem = CrossSectionAgentSystem(CrossSection=crosec, Agents=merge_4, DisplacementThreshold=-1, SoftResetValue=Slider(20, range=0..20))
trigger = Trigger(Interval=20, TimerInterval=20, Target=solver)  # disabled
solver = StepByStepSolver(Reset=Button(), Execute=Toggle(False), AgentSystems=agentsystem)  # -> DisplayGeometries, AllAgentSystems, IterationCount
panel = Panel(solver.IterationCount)
python = GhPythonScript(x=solver.AllAgentSystems)  # -> out, a
# ---------- python: Python ----------
a = x.CrossSection
# ---------- end python ----------
data_2 = Data(solver.AllAgentSystems)
python_2 = GhPythonScript(x=python.a)  # -> out, a, b
# ---------- python_2: Python ----------
boardCurves = x.BoardCurves
averageRadii = []
boards = []
for board in boardCurves:
    averageRadii.append(board.AverageRadius)
    boards.append(board.Curve)

a = averageRadii
b = boards
# ---------- end python_2 ----------
python_3 = GhPythonScript(x=data_2)  # -> out, a, b, c
# ---------- python_3: Python ----------
ids = []
points = []

for board in x.CrossSection.BoardCurves:
    ids.append(board.ControlPointID)

for agent in x.Agents:
    points.append(agent.Position)

a = x.Agents
b = ids
c = points
# ---------- end python_3 ----------

number_slider_2 = Slider(10, range=0..10)
Y = UnitY(Factor=number_slider_2)
crv = Curve(python_2.b)
extr = Extrude(Base=crv, Direction=Y)
srf = Surface(extr)

data_3 = Data(python_3.a)
smaller = SmallerThan(FirstNumber=python_2.a, SecondNumber=Slider(0.5, range=0..1))  # -> simplify(graft(SmallerThan)), OrEqualTo
num = Number(python_3.b)
pt_2 = Point(python_3.c)
not = GateNot(A=smaller.SmallerThan)
cull = CullPattern(List="-10", CullPattern=smaller.SmallerThan)
cull_2 = CullPattern(List="0", CullPattern=not)
midpt = CurveMiddle(Curve=crv)
division = Division(A=number_slider_2, B=2)
merge_5 = Merge(Data1=cull, Data2=cull_2)  # -> flatten(Result)
num_2 = Number(merge_5)
num_3 = Number(num)
c_script_2 = CSharpScript(item=num_2, map=num_3)  # -> out, A; inputs item: list, map: list of Int32
# ---------- c_script_2: C# ----------
    DataTree<Object> output = new DataTree<Object>();
    for(int i = 0; i < item.Count; i++)
    {
      GH_Path pth = new GH_Path(map[i]);
      output.Add(item[i], pth);
    }
    A = output;
# ---------- end c_script_2 ----------

srf_2 = Surface(srf)
tria = TriangularPanelsA(Surface=srf_2, UDivisions=Slider(53, range=0..100), VDivisions=Slider(1, range=0..100))  # -> simplify(Panels)
smesh = SimpleMesh(Brep=tria)
mjoin = MeshJoin(Meshes=smesh)  # -> flatten(Mesh)
mesh = Mesh(mjoin)

bnd = Bounds(Numbers=c_script_2.A)
dedomain = DeconstructDomain(Domain=bnd)  # -> flatten(Start), End
merge_6 = Merge(Data1="0", Data2=flatten(dedomain.Start), Data3="0")

# ---- group: active layer
e0 = Slider(13449, range=0..100000)
e90 = Slider(764, range=0..100000)
ft0 = Slider(80, range=0..100)
gamma = Slider(6.91, range=0..10)
num_4 = Number(Slider(20, range=0..100))

# ---- group: passive layer
num_5 = Number(Slider(4, range=0..10))
e0_2 = Slider(464, range=0..100000)
e90_2 = Slider(10800, range=0..100000)
ft0_2 = Slider(0, range=0..100)
gamma_2 = Slider(4.58, range=0..10)

# ---- group: active layer / total thickness
addition = Addition(A=num_4, B=num_5)

# ----
mesh_2 = Mesh(mesh)
num_6 = Number(num)
c_script_3 = CSharpScript(item=mesh_2, map=num_6)  # -> out, A; inputs item: list of Mesh, map: list of Int32
# ---------- c_script_3: C# ----------
    DataTree<Mesh> output = new DataTree<Mesh>();
    for(int i = 0; i < item.Count; i++)
    {
      GH_Path pth = new GH_Path(map[i]);
      output.Add(item[i], pth);
    }
    A = output;
# ---------- end c_script_3 ----------

# ---- group: active layer / distance from bottom
expression = Expression(x=addition, y=num_4, Expression="x - y/2")

# ---- group: passive layer / distance from bottom
expression_2 = Expression(x=expression, y=addition, Expression="x - y/2")

# ---- group: active layer / CG from bottom
division_2 = Division(A=addition, B=2)

# ----
mjoin_2 = MeshJoin(Meshes=c_script_3.A)  # -> flatten(Mesh)

# ---- group: passive layer / dist from CG
subtraction = Subtraction(A=expression_2, B=division_2)
abs = Absolute(Value=subtraction)

# ---- group: active layer / dist from CG
subtraction_2 = Subtraction(A=expression, B=division_2)
abs_2 = Absolute(Value=subtraction_2)

# ----
mesh_3 = Mesh(mjoin_2)

# ---- group: active layer / l
expression_3 = Expression(x=num_4, Expression="1000*x^3/12")

# ---- group: passive layer / l
expression_4 = Expression(x=num_5, Expression="1000*x^3/12")

# ---- group: passive layer / Ax2
expression_5 = Expression(x=num_5, y=abs, Expression="1000*x*y^2")

# ----
medges = MeshEdges(Mesh=mesh_3)  # -> NakedEdges, InteriorEdges, NonManifoldEdges

# ---- group: active layer / Ax2
expression_6 = Expression(x=num_4, y=abs_2, Expression="1000*x*y^2")

# ----
crv_2 = Curve(medges.NakedEdges)
explode = Explode(Curve=crv_2, Recursive=True)  # -> Segments, flatten(Vertices)

# ---- group: active layer / total l
addition_2 = Addition(A=expression_3, B=expression_6)

# ---- group: passive layer / total l
addition_3 = Addition(A=expression_4, B=expression_5)

# ----
cullpt = CullDuplicates(Points=explode.Vertices, Tolerance=0.01, CullMode=3)  # -> graft(Points), Indices, Valence
merge_7 = Merge(Data1="0", Data2=number_slider_2)

# ---- group: active layer / El0
multiplication = Multiplication(A=e0, B=addition_2)

# ---- group: active layer / T x ft0
multiplication_2 = Multiplication(A=num_4, B=ft0)

# ---- group: active layer / T x Gam
multiplication_3 = Multiplication(A=gamma, B=num_4)

# ---- group: passive layer / El0
multiplication_4 = Multiplication(A=e0_2, B=addition_3)

# ---- group: passive layer / El90
multiplication_5 = Multiplication(A=e90_2, B=addition_3)

# ---- group: passive layer / T x ft0
multiplication_6 = Multiplication(A=num_5, B=ft0_2)

# ---- group: active layer / El90
multiplication_7 = Multiplication(A=e90, B=addition_2)

# ----
pdecon = Deconstruct(Point=cullpt.Points)  # -> XComponent, YComponent, ZComponent
equals = Equality(FirstNumber=pdecon.YComponent, SecondNumber=merge_7)  # -> Equality, Inequality

# ---- group: effective material properties / El0 eff (Nmm2)
addition_4 = Addition(A=multiplication, B=multiplication_4)

# ---- group: effective material properties / El90 eff (Nmm2)
addition_5 = Addition(A=multiplication_7, B=multiplication_5)

# ---- group: effective material properties / Sum T x Ft0
addition_6 = Addition(A=multiplication_2, B=multiplication_6)

# ---- group: effective material properties / total thickness
addition_7 = Addition(A=num_4, B=num_5)

# ---- group: effective material properties / Sum Tx Gam
addition_8 = Addition(A=multiplication_3)

# ----
cset = CreateSet(List=equals.Equality)  # -> simplify(Set), Map
lng_2 = ListLength(List=cset.Set)

# ---- group: effective material properties / lx / ly
expression_7 = Expression(x=addition_7, Expression="1000*x^3/12")

# ----
larger = LargerThan(FirstNumber=lng_2, SecondNumber=1)  # -> LargerThan, OrEqualTo
cull_3 = CullPattern(List=cullpt.Points, CullPattern=larger.LargerThan)  # -> flatten(List)

# ---- group: effective material properties / E0eff
division_3 = Division(A=addition_4, B=expression_7)

# ---- group: effective material properties / E90eff
division_4 = Division(A=addition_5, B=expression_7)

# ---- group: effective material properties / Gamma eff
division_5 = Division(A=addition_8, B=addition_7)

# ---- group: effective material properties / ft eff
division_6 = Division(A=addition_6, B=addition_7)

# ---- group: effective material properties
matprops = MaterialPropertiesKaramba3D(
    FamilyOfMaterial="CLT",
    Name="CLT",
    ElementIdentifier="CLT",
    YoungsModulusKNCm2Dir1=expr("x*0.1", division_3),
    YoungsModulusKNCm2Dir2=expr("x*0.1", division_4),
    InPlaneShearModulus_kN_cm2="42",
    InPlaneLateralContractionCoefficient=Slider(0.012, range=0..0.1, expression="0.012"),
    TransverseShearModulusKNCm2Dir1="5",
    TransverseShearModulusKNCm2Dir2="5",
    SpecificWeight_kN_m3=division_5,
    CoefficientOfThermalExpansion1CDir1=1.2e-05,
    CoefficientOfThermalExpansion1CDir2=1.2e-05,
    TensileStrengthKNCm2Dir1=division_6,
    TensileStrengthKNCm2Dir2=division_6,
    CompressiveStrengthKNCm2Dir1=-23.5,
    CompressiveStrengthKNCm2Dir2=-23.5,
    ShearStrengthKNCm2Dir12=13.6,
    TsaiWuIntCoeff=0,
    StrengthHypothesis="MISES",
    mode="Orthotropic")  # -> flatten(Material)
num_7 = Number(flatten(addition_7))

# ----
avr = Average(Input=cull_3)
pdecon_2 = Deconstruct(Point=cull_3)  # -> XComponent, YComponent, ZComponent
pdecon_3 = Deconstruct(Point=avr)  # -> XComponent, YComponent, ZComponent
larger_2 = LargerThan(FirstNumber=pdecon_2.YComponent, SecondNumber=pdecon_3.YComponent)  # -> LargerThan, OrEqualTo
dispatch = Dispatch(List=cull_3, DispatchPattern=larger_2.LargerThan)  # -> ListA, ListB
supp = SupportKaramba3D(PosInd=dispatch.ListB, menu=[buttons(on, off, on, off, off, off)])
supp_2 = SupportKaramba3D(PosInd=dispatch.ListA, menu=[buttons(on, off, on, off, off, off)])
cross_section = CrossSectionKaramba3D(FamilyNameOfCrossSection="DefaultCroSec", Height_cm=expr("x/10", num_7), mode="Shell - Const")
loads = LoadsKaramba3D(Vector=Vector(0, 0, -1), LCase="0", mode="Gravity")
meshtoshell = MeshToShellKaramba3D(Mesh=mesh_3, CrossSection=cross_section, LimitDistance_m=0.005)  # -> Element, Points, Info
assemble = AssembleModelKaramba3D(
    Elem=meshtoshell.Element,
    Support=[supp, supp_2],
    Load=loads,
    CrossSection=cross_section,
    Material=matprops,
    LimitDistance_m=0.005)  # -> Model, Info, Mass_kg, CenterOfGravity, LoadCaseNames
analyze = AnalyzeKaramba3D(Model=assemble.Model)  # -> CalculatedModel, MaximumDisplacement_cm, ResultingForceOfGravity_kN, ElasticEnergyChange_kNm
modelview = ModelViewKaramba3D(Model=analyze.CalculatedModel, ResultFactors=1, ResultCase=-1)  # -> Model, DeformedMesh, DeformedAxes, DeformedModel
multiplication_8 = Multiplication(A=analyze.MaximumDisplacement_cm, B=Slider(1000, range=0..1000))
panel_2 = Panel(analyze.MaximumDisplacement_cm)
shellview = ShellViewKaramba3D(Model=modelview.Model, IndexOfLayer=0)  # -> Model, MeshesOfRenderedShells, LegendColors, LegendTags
num_8 = Number(multiplication_8)
mesh_4 = Mesh(shellview.MeshesOfRenderedShells)
bbox = BoundingBox(Content=mesh_4, Plane=PlaneXY(0, 0, 0))  # -> Box, Box_2
debox = DeconstructBox(Box=bbox.Box)  # -> Plane, X, Y, Z
dedomain_2 = DeconstructDomain(Domain=debox.Y)  # -> Start, End
neg = Negative(Value=dedomain_2.Start)
Y_2 = UnitY(Factor=neg)
move = Move(Geometry=mesh_4, Motion=Y_2)  # -> Geometry, Transform
pt_3 = Point(midpt)
num_9 = Number(division)
mesh_5 = Mesh(move.Geometry)
pt_4 = ConstructPoint(XCoordinate=0, YCoordinate=num_9, ZCoordinate=0)
xz = XZPlane(Origin=pt_4)
project = Project(Geometry=pt_3, Plane=xz)  # -> Geometry, Transform
sec = MeshPlane(Mesh=mesh_5, Plane=xz)
crv_cp = CurveClosestPoint(Point=project.Geometry, Curve=sec)  # -> Point, Parameter, Distance
num_10 = Number(num)
c_script_4 = CSharpScript(item=crv_cp.Distance, map=num_10)  # -> out, A; inputs item: list, map: list of Int32; same code as c_script_2
avr_2 = Average(Input=c_script_4.A)  # -> flatten(ArithmeticMean)
neg_2 = Negative(Value=avr_2)
python_4 = GhPythonScript(rewards=neg_2, blur=Slider(2, range=0..10))  # -> out, a; inputs rewards: list, blur: Int32
# ---------- python_4: Python ----------
blurredRewards = []

for i,reward in enumerate(rewards):
    blurValue = 0.0
    divisor = 0
    for j in range(1,blur+1):
        factor = 1/(j*2)
        if i >= j:
            blurValue += rewards[i-j] * factor
            divisor+=1
        if i + j < len(rewards):
            blurValue += rewards[i+j] * factor
            divisor+=1
    blurValue /= divisor
    blurredRewards.append( reward + blurValue)

a = blurredRewards
# ---------- end python_4 ----------
multiplication_9 = Multiplication(A=python_4.a, B=Slider(100, range=0..100))
merge_8 = Merge(Data1="0", Data2=flatten(multiplication_9), Data3="0")  # -> flatten(Result)
panel_3 = Panel(merge_8)
addition_9 = Addition(A=merge_8, B=merge_6)
train = TrainCrossSectionAgents(Agents=data_3, Reward=addition_9)
