# Grasshopper definition BilayerDesign - Rebuild.gh (Grasshopper 1.0.7)
# plug-ins: HygroDesign

panel = Panel(
    HMaxelLength=Slider(250, range=0..1000),
    HMaxelWidth=Slider(150, range=0..1000),
    LengthCount=Slider(20, range=0..100),
    WidthCount=Slider(13, range=0..100))
dec_pan = DeconstructPanel(Panel=panel)  # -> Bilayers, HMaxels
dec_hmaxel = DeconstructHMaxel(HMaxel=dec_pan.HMaxels)  # -> PassiveLayers, ActiveBoards, Height, RowRange, ColumnRange
rectangle = Rectangle(Plane=PlaneXY(0, 0, 0), XSize=dec_hmaxel.RowRange, YSize=dec_hmaxel.ColumnRange, Radius=0)  # -> Rectangle, Length
