# Grasshopper definition BilayerDesign - Variable Thickness.gh (Grasshopper 1.0.7)
# plug-ins: sof_gh_sofistik-2022, HygroDesign, Pufferfish, MeshEdit Components, Karamba3D, Kangaroo2 Components, Weaverbird, Human, LunchBox

io = IO(
    SofistikDocumentProperties_VersionMajor="2022",
    SofistikDocumentProperties_VersionMinor="0",
    SofistikDocumentProperties_VersionName="2022")

number_slider = Slider(1000, range=0..1000)
neg = Negative(Value=number_slider)
rectangle = Rectangle(Plane=PlaneXY(0, 0, 0), XSize=number_slider, YSize=neg, Radius=0)  # -> Rectangle, Length
drec = DeconstuctRectangle(Rectangle=rectangle.Rectangle)  # -> BasePlane, XInterval, YInterval
dedomain = DeconstructDomain(Domain=drec.XInterval)  # -> Start, End
dedomain_2 = DeconstructDomain(Domain=drec.YInterval)  # -> Start, End
pt = ConstructPoint(XCoordinate=dedomain.Start, YCoordinate=0, ZCoordinate=0)
pt_2 = ConstructPoint(XCoordinate=dedomain.End, YCoordinate=0, ZCoordinate=0)
subtraction = Subtraction(A=dedomain_2.End, B=dedomain_2.Start)
ln = Line(StartPoint=pt, EndPoint=pt_2)
divide = DivideCurve(Curve=ln, Count=expr("x-1", Slider(3, range=0..10)), Kinks=False)  # -> Points, Tangents, Parameters
multiplication = Multiplication(A=subtraction, B=Slider(1, range=0.5..1))
multiplication_2 = Multiplication(A=subtraction, B=Slider(0.498, range=0..0.5))
multiplication_3 = Multiplication(A=subtraction, B=Slider(1, range=0.5..1))
multiplication_4 = Multiplication(A=subtraction, B=Slider(0.5, range=0..0.5))
multiplication_5 = Multiplication(A=subtraction, B=Slider(0.5, range=0.5..1))
multiplication_6 = Multiplication(A=subtraction, B=Slider(0.467, range=0..0.5))
neg_2 = Negative(Value=multiplication_2)
neg_3 = Negative(Value=multiplication)
neg_4 = Negative(Value=multiplication_4)
neg_5 = Negative(Value=multiplication_3)
neg_6 = Negative(Value=multiplication_6)
neg_7 = Negative(Value=multiplication_5)
item = ListItem(List=divide.Points, Index=0, Wrap=True)  # -> Item, Item1, Item2
Y = UnitY(Factor=neg_2)
Y_2 = UnitY(Factor=neg_4)
Y_3 = UnitY(Factor=neg_3)
Y_4 = UnitY(Factor=neg_5)
Y_5 = UnitY(Factor=neg_6)
Y_6 = UnitY(Factor=neg_7)
move = Move(Geometry=[item.Item, item.Item2], Motion=Y)  # -> Geometry, Transform
move_2 = Move(Geometry=item.Item1, Motion=Y_3)  # -> Geometry, Transform
move_3 = Move(Geometry=[item.Item, item.Item2], Motion=Y_2)  # -> Geometry, Transform
move_4 = Move(Geometry=item.Item1, Motion=Y_4)  # -> Geometry, Transform
move_5 = Move(Geometry=[item.Item, item.Item2], Motion=Y_5)  # -> Geometry, Transform
move_6 = Move(Geometry=item.Item1, Motion=Y_6)  # -> Geometry, Transform
item_2 = ListItem(List=move.Geometry, Index=0, Wrap=True)  # -> Item, Item1
item_3 = ListItem(List=move_3.Geometry, Index=0, Wrap=True)  # -> Item, Item1
item_4 = ListItem(List=move_5.Geometry, Index=0, Wrap=True)  # -> Item, Item1
merge = Merge(Data1=flatten(item_2.Item), Data2=flatten(move_2.Geometry), Data3=flatten(item_2.Item1))
merge_2 = Merge(Data1=flatten(item_3.Item), Data2=flatten(move_4.Geometry), Data3=flatten(item_3.Item1))
merge_3 = Merge(Data1=flatten(item_4.Item), Data2=flatten(move_6.Geometry), Data3=flatten(item_4.Item1))
intcrv = Interpolate(Vertices=merge, Degree=3, Periodic=False, KnotStyle=1)  # -> Curve, Length, Domain
intcrv_2 = Interpolate(Vertices=merge_2, Degree=3, Periodic=False, KnotStyle=1)  # -> Curve, Length, Domain
intcrv_3 = Interpolate(Vertices=merge_3, Degree=3, Periodic=False, KnotStyle=1)  # -> Curve, Length, Domain
merge_4 = Merge(Data1=intcrv.Curve, Data2=intcrv_2.Curve, Data3=intcrv_3.Curve)
rec = Rectangle(rectangle.Rectangle)

species = WoodSpecies()
board_count = Slider(200, range=0..500)
species_2 = WoodSpecies(
    Name="beech",
    LExpansion=Slider(0.0001, range=0..0.0001),
    RExpansion=Slider(0.002, range=0..1),
    TExpansion=Slider(0.0041, range=0..1),
    LElasticModulus=Slider(14000, range=0..20000),
    RElasticModulus=Slider(2280, range=0..20000),
    TElasticModulus=Slider(1160, range=0..20000))
species_3 = WoodSpecies(
    Name="spruce",
    LExpansion=Slider(0.0001, range=0..0.0001),
    RExpansion=Slider(0.0019, range=0..1),
    TExpansion=Slider(0.0036, range=0..1),
    LElasticModulus=Slider(10000, range=0..20000),
    RElasticModulus=Slider(800, range=0..20000),
    TElasticModulus=Slider(450, range=0..20000))

number_slider_2 = Slider(9, range=0..10)
number_slider_3 = Slider(3000, range=0..10000)
number_slider_4 = Slider(150, range=0..10000)
xy = XYPlane(Origin=Point(0, 0, 0))
bilayer = Bilayer(
    BasePlane=xy,
    BoardWidth=number_slider_4,
    BoardLength=number_slider_3,
    WidthCount=number_slider_2,
    LengthCount=Slider(2, range=0..10),
    ActiveThickness=Slider(20, range=0..100),
    PassiveThickness=Slider(4, range=0..100),
    PassiveSpecies=species_3)
num = Number(number_slider_3)
num_2 = Number(number_slider_4)

# ---- group: name
num_3 = Number(board_count)
series = Series(Start=0, Step=1, Count=num_3)
dup = DuplicateData(Data="S", Number=num_3, Order=True)  # -> graft(Data)
txt = Text(graft(series))
merge_5 = Merge(Data1=dup, Data2=txt)  # -> simplify(Result)
join = TextJoin(Text=merge_5)  # -> flatten(Result)

# ---- group: active thickness
number_slider_5 = Slider(20, range=0..100)

# ---- group: RT
dom = ConstructDomain(DomainStart=Slider(15, range=0..100), DomainEnd=Slider(75, range=0..100))
random = Random(Range=dom, Number=board_count, Seed=Slider(225, range=0..1000))

# ---- group: name
num_4 = Number(board_count)
series_2 = Series(Start=0, Step=1, Count=num_4)
dup_2 = DuplicateData(Data="B", Number=num_4, Order=True)  # -> graft(Data)
txt_2 = Text(graft(series_2))
merge_6 = Merge(Data1=dup_2, Data2=txt_2)  # -> simplify(Result)
join_2 = TextJoin(Text=merge_6)  # -> flatten(Result)

# ---- group: thickness
num_5 = Number(number_slider_5)
num_6 = Number(board_count)
dup_3 = DuplicateData(Data=num_5, Number=num_6, Order=True)

# ---- group: length
num_7 = Number(num)
num_8 = Number(board_count)
dup_4 = DuplicateData(Data=num_7, Number=num_8, Order=True)

# ---- group: width
num_9 = Number(num_2)
num_10 = Number(board_count)
dup_5 = DuplicateData(Data=num_9, Number=num_10, Order=True)

# ---- group: beech
data = Data(species_2)

# ---- group: spruce
data_2 = Data(species_3)

# ---- group: bounding rectangle input (rectangle y domain represents full range of radii from stockpiles)
rec_2 = Rectangle(rec)

# ----
stock_boards = StockBoards(Name=join_2, Species=data, Thickness=dup_3, Length=dup_4, Width=dup_5, RTAngle=random)

# ---- group: curve controller inputs (represents distribution of radii along a given cross section)
crv = Curve(merge_4)

# ----
stock_boards_2 = StockBoards(Name=join, Species=data_2, Thickness=dup_3, Length=dup_4, Width=dup_5, RTAngle=random)
merge_7 = Merge(Data1=stock_boards, Data2=stock_boards_2)

crv_2 = Curve(crv)
lng = ListLength(List=crv_2)  # -> expr("x-2", Length)
dom_2 = ConstructDomain(DomainStart=0, DomainEnd=lng)
subset = SubList(List=crv_2, Domain=dom_2, Wrap=True)  # -> graft(List), Index
shift = ShiftList(List=crv_2, Shift=1, Wrap=False)  # -> graft(List)
merge_8 = Merge(Data1=subset.List, Data2=shift)  # -> simplify(Result)
group = Group(Objects=merge_8)  # -> flatten(Group)

deconstruct_bilayer = DeconstructBilayer(Bilayer=bilayer)
dec_board = DeconstructBoard(Board=deconstruct_bilayer)  # -> Polyline, Name, Species, RTAngle, MoistureChange, DesiredRadius, Radius, BlendedRadius, BoardRegions
area = Area(Geometry=dec_board.Polyline)  # -> Area, Centroid
c_script = CSharpScript(rects=flatten(dec_board.Polyline))  # -> out; inputs rects: list of Rectangle3d; disabled
# ---------- c_script: C# usings ----------
using Rhino.DocObjects;
# ---------- c_script: C# ----------
    var object_enumerator_settings = new ObjectEnumeratorSettings();

    var rhinoObjects = RhinoDoc.ActiveDoc.Objects.GetObjectList(object_enumerator_settings);
    var objectTable = RhinoDoc.ActiveDoc.Objects;

    foreach( var rhinoObject in rhinoObjects)
    {
      if(rhinoObject.ObjectType == ObjectType.Curve)
      {
        Curve rhinoCurve = rhinoObject.Geometry as Curve;
        if(rhinoCurve.IsClosed)objectTable.Delete(rhinoObject);
      }
    }

    foreach(var rect in rects)objectTable.AddCurve(rect.ToNurbsCurve());
# ---------- end c_script ----------
pt_3 = Point(simplify(area.Centroid))

# ---- group: generate distribution
data_3 = Data(group)
pt_4 = Point(simplify(pt_3))
pdecon = Deconstruct(Point=pt_4)  # -> XComponent, YComponent, ZComponent
bnd = Bounds(Numbers=flatten(pdecon.XComponent))
bnd_2 = Bounds(Numbers=flatten(pdecon.YComponent))
lng_2 = ListLength(List=data_3)
dedomain_3 = DeconstructDomain(Domain=bnd)  # -> Start, End
remap = RemapNumbers(Value=pdecon.YComponent, Source=bnd_2, Target=Domain(0, 1))  # -> graft(Mapped), Clipped
c_script_2 = CSharpScript(count=lng_2, start=dedomain_3.Start, end=dedomain_3.End)  # -> out, A; inputs count: Int32, start: Double, end: Double
# ---------- c_script_2: C# ----------
    double totalLength = end - start;
    double domLength = totalLength / (double) count;

    List<Interval> intervals = new List<Interval>();
    double currentStart = start;
    for(int i = 0; i < count; i++)
    {
      intervals.Add(new Interval(currentStart, currentStart + domLength));
      currentStart += domLength;
    }
    A = intervals;
# ---------- end c_script_2 ----------
num_11 = Number(graft(pdecon.XComponent))
inc = Includes(Value=num_11, Domain=simplify(c_script_2.A))  # -> Includes, Deviation
cull = CullPattern(List=data_3, CullPattern=inc.Includes)
item_5 = ListItem(List=cull, Index=0, Wrap=True)
cull_2 = CullPattern(List=c_script_2.A, CullPattern=inc.Includes)
ungroup = Ungroup(Group=item_5)  # -> simplify(Objects)
item_6 = ListItem(List=cull_2, Index=0, Wrap=True)
remap_2 = RemapNumbers(Value=num_11, Source=item_6, Target=Domain(0, 1))  # -> Mapped, Clipped
eval = EvaluateCurve(Curve=reparameterize(ungroup), Parameter=remap.Mapped)  # -> Point, Tangent, Angle
pdecon_2 = Deconstruct(Point=eval.Point)  # -> XComponent, YComponent, ZComponent
item_7 = ListItem(List=pdecon_2.YComponent, Index=0, Wrap=True)  # -> Item, Item1
twn2nums = TweenTwoNumbers(NumberA=item_7.Item, NumberB=item_7.Item1, Factor=remap_2.Mapped)
num_12 = Number(twn2nums)

# ----
bbox = BoundingBox(Content=dec_board.Polyline, Plane=PlaneXY(0, 0, 0), UnionBox=True)  # -> Box, Box_2
debox = DeconstructBox(Box=bbox.Box)  # -> Plane, X, Y, Z
dedomain_4 = DeconstructDomain(Domain=debox.X)  # -> Start, End
dedomain_5 = DeconstructDomain(Domain=debox.Y)  # -> Start, End
pt_5 = ConstructPoint(XCoordinate=dedomain_4.End, YCoordinate=dedomain_5.End, ZCoordinate=0)
pt_6 = ConstructPoint(XCoordinate=dedomain_4.Start, YCoordinate=dedomain_5.End, ZCoordinate=0)
pt_7 = ConstructPoint(XCoordinate=dedomain_4.Start, YCoordinate=dedomain_5.Start, ZCoordinate=0)
pt_8 = ConstructPoint(XCoordinate=dedomain_4.End, YCoordinate=dedomain_5.Start, ZCoordinate=0)
merge_9 = Merge(Data1=pt_5, Data2=pt_6, Data3=pt_7, Data4=pt_8)
nurbs = NurbsCurve(Vertices=merge_9, Degree=3, Periodic=False)  # -> Curve, Length, Domain

# ---- group: material / beech
data_4 = Data(species_2)

# ---- group: material / spruce
data_5 = Data(species_3)

# ---- group: material
pt_9 = Point(graft(pt_3))
crv_3 = Curve(nurbs.Curve)
xz = XZPlane(Origin=pt_9)
pcx = CurvePlane(Curve=crv_3, Plane=xz)  # -> simplify(Points), ParamsC, ParamsP
pdecon_3 = Deconstruct(Point=pcx.Points)  # -> XComponent, YComponent, ZComponent
pdecon_4 = Deconstruct(Point=pt_9)  # -> XComponent, YComponent, ZComponent
smaller = SmallerThan(FirstNumber=pdecon_3.XComponent, SecondNumber=pdecon_4.XComponent)  # -> SmallerThan, OrEqualTo
not = GateNot(A=smaller.SmallerThan)
cull_3 = CullPattern(List=data_4, CullPattern=not)
cull_4 = CullPattern(List=data_5, CullPattern=smaller.SmallerThan)
merge_10 = Merge(Data1=cull_3, Data2=cull_4)  # -> simplify(Result)
path_mapper = PathMapper(merge_10, source="{A}", target="{0}")

# ----
dec_reg = DeconstructBoardRegion(BoardRegion=dec_board.BoardRegions)  # -> Polyline, Name, Species, RTAngle, MoistureChange, DesiredRadius, Radius, BlendedRadius, ThicknessBlendedRadius
area_2 = Area(Geometry=dec_reg.Polyline)  # -> Area, Centroid

pt_10 = Point(simplify(area_2.Centroid))
pdecon_5 = Deconstruct(Point=pt_10)  # -> XComponent, YComponent, ZComponent
bnd_3 = Bounds(Numbers=flatten(pdecon_5.XComponent))
dom_3 = ConstructDomain(DomainStart=Slider(1.2, range=0..1.2), DomainEnd=Slider(0.21, range=0..1))
remap_3 = RemapNumbers(Value=pdecon_5.XComponent, Source=bnd_3, Target=dom_3)  # -> Mapped, Clipped
roundd = RoundToDecimalPlace(NumberX=remap_3.Mapped, DecimalPlace=Slider(10, range=0..10), RoundType=0)  # -> Rounded, Difference

pt_11 = Point(pt_3)
pdecon_6 = Deconstruct(Point=pt_11)  # -> XComponent, YComponent, ZComponent
bnd_4 = Bounds(Numbers=flatten(pdecon_6.XComponent))
dom_4 = ConstructDomain(DomainStart="1", DomainEnd="0")
remap_4 = RemapNumbers(Value=pdecon_6.XComponent, Source=bnd_4, Target=dom_4)  # -> simplify(Mapped), Clipped

num_13 = Number(num_12)
rec_3 = Rectangle(rec_2)
drec_2 = DeconstuctRectangle(Rectangle=rec_3)  # -> BasePlane, XInterval, YInterval
dom_5 = ConstructDomain(DomainStart=0, DomainEnd=1)
remap_5 = RemapNumbers(Value=num_13, Source=drec_2.YInterval, Target=dom_5)  # -> Mapped, Clipped
trim = TrimTree(Tree=remap_5.Mapped, Depth=1)

data_6 = Data(bilayer)
tag = TextTag3D(Location=pt_10, Text=remap_3.Mapped, Size=Slider(87, range=0..100), Justification=5)
update_bilayer = UpdateBilayer(Bilayer=data_6, Radius=trim, RadiusWeight=remap_4.Mapped, Material=path_mapper)
dup_bilayer = DuplicateBilayer(Bilayer=update_bilayer, Count=Slider(3, range=0..10))

# ---- group: moisture changes
step_size = Slider(4, range=0..10)
series_3 = Series(Start=step_size, Step=step_size, Count=Slider(4, range=0..10))
num_14 = Number(series_3)

# ----
panel = Panel(Bilayers=dup_bilayer)
adjust_cro_sec = AdjustCrossSection(Panel=panel, Thicknesses=remap_3.Mapped)
dup_panel = DuplicatePanel(Panel=adjust_cro_sec, Count=Slider(2, range=0..10))
data_7 = Data(merge_7)
design_env = DesignEnvironment(Panels=dup_panel, StockBoards=data_7, MoistureChanges=num_14)  # -> Panels, StockBoards
cross_section = BooleanToggle(True)
relaxation = BooleanToggle(False)
convolution = CurvatureConvolution(
    Panels=design_env.Panels,
    TengentialBlending=Slider(0.34, range=0.01..3),
    LongitudinalBlending=Slider(0.3, range=0.01..3),
    MaxRadiusInfluence=100000,
    StiffnessFactor=0.1,
    ThicknessFactor=0.1,
    VisualizeBoardWeights=0)  # -> Panels, Weights
cull_5 = CullPattern(List=convolution.Panels, CullPattern=cross_section)
item_8 = ListItem(List=convolution.Panels, Index=0, Wrap=True)  # -> Item, Item1
crosecset = UniqueCrossSections(Panel=cull_5)
dec_reg_2 = DeconstructBoardRegion(BoardRegion=crosecset)  # -> Polyline, ThicknessBlendedRadius, Species, MoistureChange, DesiredRadius, Radius, BlendedRadius, ThicknessBlendedRadius_2, ThicknessBlendedRadius_3
Y_7 = UnitY(Factor=Slider(3788, range=0..10000))
Y_8 = UnitY(Factor=Slider(1883, range=0..10000))
Y_9 = UnitY(Factor=Slider(5667, range=0..10000))
Y_10 = UnitY(Factor=Slider(7531, range=0..10000))

vec = Vector(Y_9)
data_8 = Data(item_8.Item)
display_panel = DisplayPanels(Panels=data_8)  # -> ActiveBoards, PassiveBoards
deconstruct_panel = DeconstructPanel(Panel=data_8)
deconstruct_bilayer_2 = DeconstructBilayer(Bilayer=deconstruct_panel)
dec_board_2 = DeconstructBoard(Board=deconstruct_bilayer_2)  # -> Polyline, Name, Species, RTAngle, MoistureChange, DesiredRadius, Radius, BlendedRadius, BoardRegions
move_7 = Move(Geometry=display_panel.ActiveBoards, Motion=vec)  # -> Geometry, Transform
move_8 = Move(Geometry=display_panel.PassiveBoards, Motion=vec)  # -> Geometry, Transform
dec_reg_3 = DeconstructBoardRegion(BoardRegion=dec_board_2.BoardRegions)  # -> Polyline, Name, Species, RTAngle, MoistureChange, DesiredRadius, Radius, BlendedRadius, ThicknessBlendedRadius
bnd_5 = Bounds(Numbers=flatten(dec_reg_3.RTAngle))
dedomain_6 = DeconstructDomain(Domain=bnd_5)  # -> Start, End
gradient = Gradient(
    LowerLimit=dedomain_6.Start,
    UpperLimit=dedomain_6.End,
    Parameter=dec_reg_3.RTAngle,
    stops=[0: RGB(124, 0, 219), 1: RGB(207, 130, 255)])
preview = CustomPreview(Geometry=move_7.Geometry, Material=gradient)
preview_2 = CustomPreview(Geometry=move_8.Geometry, Material=ColourSwatch(SwatchColor=RGB(115, 115, 115)))

bool = Boolean(relaxation)
Y_11 = UnitY(Factor=Slider(5928, range=0..10000))
Y_12 = UnitY(Factor=Slider(2905, range=0..10000))

cull_6 = CullPattern(List=cull_5, CullPattern=cross_section)
deconstruct_panel_2 = DeconstructPanel(Panel=cull_6)
deconstruct_bilayer_3 = DeconstructBilayer(Bilayer=deconstruct_panel_2)
dec_board_3 = DeconstructBoard(Board=deconstruct_bilayer_3)  # -> Polyline, Name, Species, RTAngle, MoistureChange, DesiredRadius, Radius, BlendedRadius, BoardRegions
dec_reg_4 = DeconstructBoardRegion(BoardRegion=dec_board_3.BoardRegions)  # -> Polyline, ThicknessBlendedRadius, Species, MoistureChange, DesiredRadius, Radius, BlendedRadius, ThicknessBlendedRadius_2, ThicknessBlendedRadius_3

crv_4 = Curve(dec_reg_2.Polyline)
area_3 = Area(Geometry=crv_4)  # -> Area, Centroid
avr = Average(Input=area_3.Centroid)
bbox_2 = BoundingBox(Content=flatten(avr), Plane=PlaneXY(0, 0, 0), UnionBox=True)  # -> Box, Box_2
debox_2 = DeconstructBox(Box=bbox_2.Box)  # -> Plane, X, Y, Z
dedomain_7 = DeconstructDomain(Domain=debox_2.X)  # -> Start, End
subtraction_2 = Subtraction(A=dedomain_7.End, B=dedomain_7.Start)

trim_2 = TrimTree(Tree=crv_4, Depth=1)

bbox_3 = BoundingBox(Content=trim_2, Plane=PlaneXY(0, 0, 0), UnionBox=True)  # -> Box, Box_2
debox_3 = DeconstructBox(Box=bbox_3.Box)  # -> Plane, X, Y, Z
dedomain_8 = DeconstructDomain(Domain=debox_3.X)  # -> Start, End
subtraction_3 = Subtraction(A=dedomain_8.End, B=dedomain_8.Start)
area_4 = Area(Geometry=bbox_3.Box)  # -> Area, Centroid
division = Division(A=subtraction_3, B=subtraction_2)
scale = Scale(Geometry=avr, Center=area_4.Centroid, Factor=division)  # -> Geometry, Transform
yz = YZPlane(Origin=scale.Geometry)

num_15 = Number(num_2)
num_16 = Number(dec_reg_2.ThicknessBlendedRadius)
pln = Plane(yz)
c_script_3 = CSharpScript(iRadii=num_16, iBoardWidth=num_15, iPlanes=pln)  # -> out, simplify(A); inputs iRadii: tree of Double, iBoardWidth: Double, iPlanes: tree of Plane
# ---------- c_script_3: C# ----------
    DataTree<Point3d> pointTree = new DataTree<Point3d>();

    for (int j = 0; j < iRadii.BranchCount; j++)
    {

      //initialize variables
      Plane bp = iPlanes.Branch(j)[0];
      Point3d startPoint = new Point3d(bp.Origin);
      Point3d centerPoint = startPoint;
      Vector3d rotationAxis = new Vector3d(bp.ZAxis);
      Vector3d centerPointVect = new Vector3d(bp.YAxis);
      centerPointVect.Rotate(Math.PI / 2, rotationAxis);

      for (int i = 0; i < iRadii.Branch(j).Count; i++){
        GH_Path pth = iRadii.Paths[j].AppendElement(i);
        Point3d point1 = startPoint;
        Point3d point2 = startPoint;

        pointTree.Add(point1, pth);

        //calculate rotation angle
        Double arcLength = iBoardWidth;
        Double radius = iRadii.Branch(j)[i];
        Double rotation = (arcLength / radius);

        //calculate rotation center point
        centerPointVect.Unitize();
        centerPointVect *= radius;
        centerPoint += centerPointVect;


        //execute half rotation
        Transform tx = Transform.Rotation(rotation / 2, rotationAxis, centerPoint);


        point2.Transform(tx);
        pointTree.Add(point2, pth);

        //execute full rotation
        tx = Transform.Rotation(rotation, rotationAxis, centerPoint);
        startPoint.Transform(tx);
        pointTree.Add(startPoint, pth);

        //updata rotation parameters
        centerPoint = startPoint;
        centerPointVect.Transform(tx);
      }
    }
    A = pointTree;
# ---------- end c_script_3 ----------

panel_2 = Panel(num_16)

trim_3 = TrimTree(Tree=c_script_3.A, Depth=1)
cullpt = CullDuplicates(Points=trim_3, Tolerance=0.1, CullMode=3)  # -> Points, Indices, Valence
pt_12 = Point(cullpt.Points)

# ---- group: animate
pt_13 = Point(simplify(pt_12))
pln_2 = Plane(graft(pln))
num_17 = Number(Slider(1, range=0..1))
c_script_4 = CSharpScript(iPoints=simplify(pt_13), iPlanes=pln_2, iShapeFactor=num_17)  # -> out, A; inputs iPoints: tree of Point3d, iPlanes: tree of Plane, iShapeFactor: Double
# ---------- c_script_4: C# ----------
    DataTree<Point3d> output = new DataTree<Point3d>();
    
    double shapeFactor = 1.0 - iShapeFactor;

    //step through curves
    for (int i = 0; i < iPoints.BranchCount; i++)
    {
      Plane currentPlane = iPlanes.Branch(iPoints.Path(i)[0])[0];

      //get vectors from plane
      Vector3d zVect = currentPlane.YAxis;

      Vector3d rotVect = currentPlane.ZAxis;

      //create new startpoint inside list
      Point3d startPoint = iPoints.Branch(i)[0];

      //step through points. Create and rotate vectors
      for (int j = 0; j < iPoints.Branch(i).Count; j++)
      {
        if (j == 0) output.Add(startPoint, iPoints.Path(i));
        else{
          //create current segment vector
          Vector3d segmentVect = new Vector3d(iPoints.Branch(i)[j] - iPoints.Branch(i)[j - 1]);

          //measure angle with vertical vector
          double angle = Vector3d.VectorAngle(zVect, segmentVect, currentPlane);

          //rotate
          segmentVect.Rotate(-angle * shapeFactor, rotVect);

          startPoint += segmentVect;
          output.Add(startPoint, iPoints.Path(i));
        }
      }
    }

    A = output;
# ---------- end c_script_4 ----------
pt_14 = Point(c_script_4.A)
intcrv_4 = Interpolate(Vertices=pt_14, Degree=3, Periodic=False, KnotStyle=1)  # -> Curve, Length, Domain
crv_5 = Curve(intcrv_4.Curve)

# ----
crv_6 = Curve(crv_5)
pt_15 = Point(simplify(graft(scale.Geometry)))
end = EndPoints(Curve=crv_6)  # -> Start, End
vec2pt = Vector2Pt(PointA=end.Start, PointB=end.End, Unitize=False)  # -> Vector, Length
yz_2 = YZPlane(Origin=end.Start)
Y_13 = UnitY(Factor="-1")
angle = Angle(VectorA=vec2pt.Vector, VectorB=Y_13, Plane=yz_2)  # -> Angle, Reflex
rotate = Rotate(Geometry=crv_6, Angle=angle.Angle, Plane=yz_2)  # -> Geometry, Transform
curvepoint = PointOnCurve(rotate.Geometry, parameter=0.5)
vec2pt_2 = Vector2Pt(PointA=curvepoint, PointB=pt_15, Unitize=False)  # -> Vector, Length
move_9 = Move(Geometry=rotate.Geometry, Motion=vec2pt_2.Vector)  # -> Geometry, Transform
path_mapper_2 = PathMapper(move_9.Geometry, source=["{A;B}", "{A}"], target=["{A}", "{0}"])
crv_7 = Curve(reverse(path_mapper_2))
loft = Loft(Curves=crv_7, Options={Adjust=False, Closed=False, LoftEnds=0, LoftSimp=0, LoftType=2, Rebuild=10, Refit=0.01})

cull_7 = CullPattern(List=loft, CullPattern=bool)

number_slider_6 = Slider(8, range=0..100)
num_18 = Number(number_slider_2)
srf = Surface(cull_7)
quads = QuadPanels(Surface=srf, UDivisions=number_slider_6, VDivisions=num_18)
srf_2 = Surface(reparameterize(simplify(quads)))

smesh = SimpleMesh(Brep=srf_2)
area_5 = MeshArea(Mesh=smesh)  # -> Area, Centroid
meshcp = MeshClosestPoint(Point=area_5.Centroid, Mesh=smesh)  # -> Point, Index, Parameter
meval = MeshEval(Mesh=smesh, Parameter=meshcp.Parameter)  # -> Point, Normal, Colour
pl = PlaneNormal(Origin=meval.Point, ZAxis=meval.Normal)
X = UnitX(Factor=1)
deplane = DeconstructPlane(Plane=pl)  # -> Origin, XAxis, YAxis, ZAxis
angle_2 = Angle(VectorA=deplane.XAxis, VectorB=X, Plane=pl)  # -> Angle, Reflex
rotate_2 = Rotate(Geometry=pl, Angle=angle_2.Angle, Plane=pl)  # -> graft(Geometry), Transform

medges = MeshEdges(Mesh=smesh)  # -> simplify(NakedEdges), InteriorEdges, NonManifoldEdges
curvepoint_2 = PointOnCurve(medges.NakedEdges, parameter=0.5)
plcoord = PlaneCoordinates(Point=curvepoint_2, System=rotate_2.Geometry)  # -> XCoordinate, YCoordinate, ZCoordinate
sort = SortList(Keys=plcoord.XCoordinate, ValuesA=medges.NakedEdges)  # -> Keys, ValuesA
item_9 = ListItem(List=reverse(sort.ValuesA), Index=0, Wrap=True)
item_10 = ListItem(List=sort.ValuesA, Index=0, Wrap=True)

merge_11 = Merge(Data1=item_10, Data2=item_9)
trim_4 = TrimTree(Tree=merge_11, Depth=1)
rdlines = RemoveDuplicateLinesKaramba3D(Line=trim_4, LimitDistance=0.005)  # -> OutLine, Info, Indexes
join_3 = JoinCurves(Curves=rdlines.OutLine, Preserve=False)
explode = Explode(Curve=join_3, Recursive=True)  # -> Segments, simplify(Vertices)
pline = PolyLine(Vertices=explode.Vertices, Closed=False)  # -> simplify(graft(Polyline))
path_mapper_3 = PathMapper(pline, source=["{A}", "{A;B}"], target=["{0}", "{A}"])
curvepoint_3 = PointOnCurve(path_mapper_3, parameter=0.5)
pdecon_7 = Deconstruct(Point=curvepoint_3)  # -> XComponent, YComponent, ZComponent
sort_2 = SortList(Keys=pdecon_7.XComponent, ValuesA=path_mapper_3)  # -> Keys, ValuesA
crv_8 = Curve(sort_2.ValuesA)

crv_9 = Curve(crv_8)
item_11 = ListItem(List=crv_9, Index=0, Wrap=True)
curvepoint_4 = PointOnCurve(crv_9, parameter=0.5)
curvepoint_5 = PointOnCurve(item_11, parameter=0.5)
vec2pt_3 = Vector2Pt(PointA=curvepoint_5, PointB=curvepoint_4, Unitize=False)  # -> Vector, Length
move_10 = Move(Geometry=item_11, Motion=vec2pt_3.Vector)  # -> Geometry, Transform

crv_10 = Curve(crv_8)
flip = FlipCurve(Curve=crv_10, Guide=move_10.Geometry)  # -> Curve, Flag

explode_2 = Explode(Curve=flip.Curve, Recursive=True)  # -> simplify(Segments), Vertices
explode_3 = Explode(Curve=move_10.Geometry, Recursive=True)  # -> simplify(Segments), Vertices
lng_3 = ListLength(List=explode_2.Segments)
lng_4 = ListLength(List=explode_2.Segments)
lng_5 = ListLength(List=explode_3.Segments)
lng_6 = ListLength(List=explode_3.Segments)
subtraction_4 = Subtraction(A=lng_3, B=2)
subtraction_5 = Subtraction(A=lng_4, B=1)
subtraction_6 = Subtraction(A=lng_5, B=2)
subtraction_7 = Subtraction(A=lng_6, B=1)
dom_6 = ConstructDomain(DomainStart=0, DomainEnd=subtraction_4)
dom_7 = ConstructDomain(DomainStart=1, DomainEnd=subtraction_5)
dom_8 = ConstructDomain(DomainStart=0, DomainEnd=subtraction_6)
dom_9 = ConstructDomain(DomainStart=1, DomainEnd=subtraction_7)
subset_2 = SubList(List=explode_2.Segments, Domain=dom_6, Wrap=True)  # -> List, Index
subset_3 = SubList(List=explode_2.Segments, Domain=dom_7, Wrap=True)  # -> List, Index
subset_4 = SubList(List=explode_3.Segments, Domain=dom_8, Wrap=True)  # -> List, Index
subset_5 = SubList(List=explode_3.Segments, Domain=dom_9, Wrap=True)  # -> List, Index
angle_3 = Angle(VectorA=subset_4.List, VectorB=subset_5.List)  # -> simplify(Angle), Reflex
angle_4 = Angle(VectorA=subset_2.List, VectorB=subset_3.List)  # -> simplify(Angle), Reflex
num_19 = Number(angle_3.Angle)
num_20 = Number(angle_4.Angle)

explode_4 = Explode(Curve=flip.Curve, Recursive=True)  # -> simplify(Segments), Vertices
explode_5 = Explode(Curve=move_10.Geometry, Recursive=True)  # -> simplify(Segments), Vertices
path_mapper_4 = PathMapper(explode_4.Segments, source=["{A}(i)", "{A;B}(i)"], target=["{i}(A)", "{A;i}(B)"])
path_mapper_5 = PathMapper(explode_5.Segments, source=["{A}(i)", "{A;B}(i)"], target=["{i}(A)", "{A;i}(B)"])
crv_11 = Curve(path_mapper_5)
crv_12 = Curve(path_mapper_4)
lng_7 = ListLength(List=crv_12)  # -> expr("x-2", Length)
lng_8 = ListLength(List=crv_11)  # -> expr("x-2", Length)
lng_9 = ListLength(List=crv_12)  # -> expr("x-1", Length)
lng_10 = ListLength(List=crv_11)  # -> expr("x-1", Length)
dom_10 = ConstructDomain(DomainStart=0, DomainEnd=lng_7)
dom_11 = ConstructDomain(DomainStart=0, DomainEnd=lng_8)
dom_12 = ConstructDomain(DomainStart=1, DomainEnd=lng_9)
dom_13 = ConstructDomain(DomainStart=1, DomainEnd=lng_10)
subset_6 = SubList(List=crv_12, Domain=dom_10, Wrap=True)  # -> graft(List), Index
subset_7 = SubList(List=crv_11, Domain=dom_11, Wrap=True)  # -> graft(List), Index
subset_8 = SubList(List=crv_12, Domain=dom_12, Wrap=True)  # -> graft(List), Index
subset_9 = SubList(List=crv_11, Domain=dom_13, Wrap=True)  # -> graft(List), Index
loft_2 = Loft(
    Curves=[subset_6.List, subset_8.List],
    Options={Adjust=False, Closed=False, LoftEnds=0, LoftSimp=0, LoftType=0, Rebuild=10, Refit=0.01})  # -> simplify(Loft)
loft_3 = Loft(
    Curves=[subset_7.List, subset_9.List],
    Options={Adjust=False, Closed=False, LoftEnds=0, LoftSimp=0, LoftType=0, Rebuild=10, Refit=0.01})  # -> simplify(Loft)
smesh_2 = SimpleMesh(Brep=loft_2)
smesh_3 = SimpleMesh(Brep=loft_3)
path_mapper_6 = PathMapper(smesh_3, source=["{A;B;C}", "{A;B}"], target=["{A}", "{0}"])
path_mapper_7 = PathMapper(smesh_2, source=["{A;B;C}", "{A;B}"], target=["{A}", "{0}"])
mjoin = MeshJoin(Meshes=path_mapper_6)
mjoin_2 = MeshJoin(Meshes=path_mapper_7)
weld = WeldMesh(Mesh=mjoin, Angle=3.141592654)
weld_2 = WeldMesh(Mesh=mjoin_2, Angle=3.141592654)

vec_2 = Vector(Y_10)
data_9 = Data(item_8.Item)
display_panel_2 = DisplayPanels(Panels=data_9)  # -> ActiveBoards, PassiveBoards
deconstruct_panel_3 = DeconstructPanel(Panel=data_9)
deconstruct_bilayer_4 = DeconstructBilayer(Bilayer=deconstruct_panel_3)
move_11 = Move(Geometry=display_panel_2.ActiveBoards, Motion=vec_2)  # -> Geometry, Transform
move_12 = Move(Geometry=display_panel_2.PassiveBoards, Motion=vec_2)  # -> Geometry, Transform
dec_board_4 = DeconstructBoard(Board=deconstruct_bilayer_4)  # -> Polyline, Name, Species, RTAngle, MoistureChange, DesiredRadius, Radius, BlendedRadius, BoardRegions
dec_reg_5 = DeconstructBoardRegion(BoardRegion=dec_board_4.BoardRegions)  # -> Polyline, Name, Species, RTAngle, MoistureChange, DesiredRadius, Radius, BlendedRadius, ThicknessBlendedRadius
preview_3 = CustomPreview(Geometry=move_12.Geometry, Material=ColourSwatch(SwatchColor=RGB(115, 115, 115)))

python = GhPythonScript(x=dec_reg_5.Species)  # -> out, a
# ---------- python: Python ----------
a = x.Name
# ---------- end python ----------
len = TextLength(Text=python.a)
bnd_6 = Bounds(Numbers=flatten(len))
dedomain_9 = DeconstructDomain(Domain=bnd_6)  # -> Start, End

gradient_2 = Gradient(
    LowerLimit=dedomain_9.Start,
    UpperLimit=dedomain_9.End,
    Parameter=len,
    stops=[0: RGB(80, 55, 25), 0.5: RGB(159, 65, 29), 1: RGB(174, 166, 129)])
preview_4 = CustomPreview(Geometry=move_11.Geometry, Material=gradient_2)

vec_3 = Vector(Y_8)
data_10 = Data(item_8.Item)
deconstruct_panel_4 = DeconstructPanel(Panel=data_10)
display_panel_3 = DisplayPanels(Panels=data_10)  # -> ActiveBoards, PassiveBoards
deconstruct_bilayer_5 = DeconstructBilayer(Bilayer=deconstruct_panel_4)
move_13 = Move(Geometry=display_panel_3.ActiveBoards, Motion=vec_3)  # -> Geometry, Transform
move_14 = Move(Geometry=display_panel_3.PassiveBoards, Motion=vec_3)  # -> Geometry, Transform
swatch = ColourSwatch(SwatchColor=RGBA(0, 0, 0, 66))

dec_board_5 = DeconstructBoard(Board=deconstruct_bilayer_5)  # -> Polyline, Name, Species, RTAngle, MoistureChange, DesiredRadius, Radius, BlendedRadius, BoardRegions
dec_reg_6 = DeconstructBoardRegion(BoardRegion=dec_board_5.BoardRegions)  # -> Polyline, Name, Species, RTAngle, MoistureChange, DesiredRadius, Radius, BlendedRadius, ThicknessBlendedRadius

c_script_5 = CSharpScript(desired=dec_reg_6.DesiredRadius, actual=dec_reg_6.ThicknessBlendedRadius)  # -> out, A; inputs desired: Double, actual: Double
# ---------- c_script_5: C# ----------
    A = 100 * Math.Abs(desired - actual) / ((desired + actual) / 2);
# ---------- end c_script_5 ----------
gradient_3 = Gradient(LowerLimit=0, UpperLimit="100", Parameter=c_script_5.A, stops=[0.15: RGB(255, 130, 160), 0.85: RGB(220, 0, 40)])
preview_5 = CustomPreview(Geometry=move_13.Geometry, Material=gradient_3)
preview_6 = CustomPreview(Geometry=move_14.Geometry, Material=gradient_3)

vec_4 = Vector(Y_7)
data_11 = Data(item_8.Item)
deconstruct_panel_5 = DeconstructPanel(Panel=data_11)
display_panel_4 = DisplayPanels(Panels=data_11)  # -> ActiveBoards, PassiveBoards
deconstruct_bilayer_6 = DeconstructBilayer(Bilayer=deconstruct_panel_5)
dec_board_6 = DeconstructBoard(Board=deconstruct_bilayer_6)  # -> Polyline, Name, Species, RTAngle, MoistureChange, DesiredRadius, Radius, BlendedRadius, BoardRegions
move_15 = Move(Geometry=display_panel_4.ActiveBoards, Motion=vec_4)  # -> Geometry, Transform
move_16 = Move(Geometry=display_panel_4.PassiveBoards, Motion=vec_4)  # -> Geometry, Transform
dec_reg_7 = DeconstructBoardRegion(BoardRegion=dec_board_6.BoardRegions)  # -> Polyline, Name, Species, RTAngle, MoistureChange, DesiredRadius, Radius, BlendedRadius, ThicknessBlendedRadius
preview_7 = CustomPreview(Geometry=move_16.Geometry, Material=ColourSwatch(SwatchColor=RGB(115, 115, 115)))

bnd_7 = Bounds(Numbers=flatten(dec_reg_7.MoistureChange))
panel_3 = Panel(dec_reg_7.MoistureChange)
dedomain_10 = DeconstructDomain(Domain=bnd_7)  # -> Start, End

gradient_4 = Gradient(
    LowerLimit=dedomain_10.Start,
    UpperLimit=dedomain_10.End,
    Parameter=dec_reg_7.MoistureChange,
    stops=[0.15: RGB(130, 253, 255), 0.85: RGB(0, 172, 219)])
preview_8 = CustomPreview(Geometry=move_15.Geometry, Material=gradient_4)

explode_6 = Explode(Curve=move_10.Geometry, Recursive=True)  # -> Segments, Vertices
num_21 = Number(num_20)
num_22 = Number(num_19)
mesh = Mesh(weld)
path_mapper_8 = PathMapper(explode_6.Vertices, source=["{A;B}(i)", "{A}(i)"], target=["{A;i}(B)", "{i}(A)"])
division_2 = Division(A=num_21, B=num_22)
avr_2 = Average(Input=division_2)
number_slider_7 = Slider(100, range=0..100000)
pline_2 = PolyLine(Vertices=path_mapper_8, Closed=False)  # -> simplify(Polyline)
path_mapper_9 = PathMapper(pline_2, source=["{A;B}", "{A}"], target=["{A}", "{0}"])
crv_13 = Curve(move_10.Geometry)
show = Show(G=mesh)
rod = Rod(
    Polyline=path_mapper_9,
    LengthFactor=1,
    AngleFactor=1,
    AxialStrength=number_slider_7,
    BendStrength=Slider(1, range=0..10000))
path_mapper_10 = PathMapper(rod, source=["{A;B}", "{A}"], target=["{A}", "{0}"])

path_mapper_11 = PathMapper(avr_2, source=["{A}", "{A;B}"], target=["{0}", "{A}"])

rod_2 = Rod(
    Polyline=crv_13,
    LengthFactor=1,
    AngleFactor=path_mapper_11,
    AxialStrength=number_slider_7,
    BendStrength=Slider(10000, range=0..10000))
path_mapper_12 = PathMapper(rod_2, source=["{A;B}", "{A}"], target=["{A}", "{0}"])
merge_12 = Merge(Data1=path_mapper_10, Data2=path_mapper_12, Data3=show)

zombiesolver = ZombieSolver(GoalObjects=merge_12, Threshold=1e-10, Tolerance=0.0001, MaxIterations=Slider(1, range=0..100000))  # -> I, V, O
mesh_2 = Mesh(zombiesolver.O)
clean = CleanTree(RemoveNulls=True, RemoveInvalid=True, RemoveEmpty=False, Tree=mesh_2)

mesh_3 = Mesh(simplify(graft(clean)))

mesh_4 = Mesh(mesh_3)
num_23 = Number(expr("x+1", number_slider_6))
medges_2 = MeshEdges(Mesh=mesh_4)  # -> NakedEdges, InteriorEdges, NonManifoldEdges
demesh = DeconstructMesh(Mesh=mesh_4)  # -> Vertices, Faces, Colours, Normals
join_4 = JoinCurves(Curves=medges_2.NakedEdges, Preserve=False)
patch = Patch(Curves=join_4, Points=demesh.Vertices, Spans=num_23, Flexibility=Slider(1, range=0..1), Trim=True)
srf_3 = Surface(simplify(patch))

wbedges = WeaverbirdsMeshEdges(MeshOrPolylines=graft(clean))  # -> simplify(Lines)
wbedges_2 = WeaverbirdsMeshEdges(MeshOrPolylines=weld_2)  # -> simplify(Lines)
group_2 = Group(Objects=wbedges)  # -> flatten(Group)
len_2 = Length(Curve=wbedges_2)
len_3 = Length(Curve=wbedges)
lng_11 = ListLength(List=group_2)
subtraction_8 = Subtraction(A=len_3, B=len_2)
series_4 = Series(Start=0, Step=Slider(1330, range=0..10000), Count=lng_11)
smaller_2 = SmallerThan(FirstNumber=subtraction_8, SecondNumber=0)  # -> SmallerThan, OrEqualTo
dispatch = Dispatch(List=subtraction_8, DispatchPattern=smaller_2.SmallerThan)  # -> ListA, ListB
Y_14 = UnitY(Factor=series_4)
move_17 = Move(Geometry=group_2, Motion=Y_14)  # -> Geometry, Transform
bnd_8 = Bounds(Numbers=dispatch.ListA)
bnd_9 = Bounds(Numbers=dispatch.ListB)
dedomain_11 = DeconstructDomain(Domain=bnd_9)  # -> Start, End
dedomain_12 = DeconstructDomain(Domain=bnd_8)  # -> Start, End
X_2 = UnitX(Factor=Slider(7456, range=0..10000))
gradient_5 = Gradient(
    LowerLimit=dedomain_11.Start,
    UpperLimit=dedomain_11.End,
    Parameter=dispatch.ListB,
    stops=[0: RGB(254, 244, 84), 0.499: RGB(234, 126, 0), 1: RGB(234, 38, 0), 1: RGB(75, 107, 169), 1: RGB(173, 203, 249)])

crv_14 = Curve(wbedges)
end_2 = EndPoints(Curve=crv_14)  # -> Start, End
pdecon_8 = Deconstruct(Point=end_2.Start)  # -> XComponent, YComponent, ZComponent
pdecon_9 = Deconstruct(Point=end_2.End)  # -> XComponent, YComponent, ZComponent
subtraction_9 = Subtraction(A=pdecon_8.XComponent, B=pdecon_9.XComponent)
abs = Absolute(Value=subtraction_9)
smaller_3 = SmallerThan(FirstNumber=abs, SecondNumber=Slider(100, range=0..100))  # -> SmallerThan, OrEqualTo
cull_8 = CullPattern(List=crv_14, CullPattern=smaller_3.SmallerThan)
join_5 = JoinCurves(Curves=cull_8, Preserve=False)
curvepoint_6 = PointOnCurve(join_5, parameter=0.5)
pdecon_10 = Deconstruct(Point=curvepoint_6)  # -> XComponent, YComponent, ZComponent
sort_3 = SortList(Keys=pdecon_10.XComponent, ValuesA=join_5)  # -> Keys, ValuesA
explode_7 = Explode(Curve=sort_3.ValuesA, Recursive=True)  # -> Segments, simplify(Vertices)
intcrv_5 = Interpolate(Vertices=explode_7.Vertices, Degree=3, Periodic=False, KnotStyle=1)  # -> Curve, Length, Domain
path_mapper_13 = PathMapper(intcrv_5.Curve, source=["{A;B}", "{A}"], target=["{A}", "{0}"])
loft_4 = Loft(Curves=path_mapper_13, Options={Adjust=False, Closed=False, LoftEnds=0, LoftSimp=0, LoftType=0, Rebuild=10, Refit=0.01})

move_18 = Move(Geometry=move_17.Geometry, Motion=Y_11)  # -> Geometry, Transform
gradient_6 = Gradient(
    LowerLimit=dedomain_12.Start,
    UpperLimit=dedomain_12.End,
    Parameter=dispatch.ListA,
    stops=[0: RGB(75, 107, 169), 0.501: RGB(173, 203, 249), 1: RGB(254, 244, 84)])

move_19 = Move(Geometry=move_18.Geometry, Motion=X_2)  # -> Geometry, Transform
ungroup_2 = Ungroup(Group=move_19.Geometry)
dispatch_2 = Dispatch(List=ungroup_2, DispatchPattern=smaller_2.SmallerThan)  # -> ListA, ListB
previewlw = CustomPreviewLineweights(Geometry=dispatch_2.ListA, Shader=gradient_6, Thickness=3, Absolute=False)
previewlw_2 = CustomPreviewLineweights(Geometry=dispatch_2.ListB, Shader=gradient_5, Thickness=3, Absolute=False)

# ---- group: control gate
srf_4 = Surface(loft_4)
srf_5 = Surface(loft)
bool_2 = Boolean(relaxation)
not_2 = GateNot(A=bool_2)
cull_9 = CullPattern(List=srf_5, CullPattern=not_2)
merge_13 = Merge(Data1=srf_4, Data2=cull_9)

# ----
srf_6 = Surface(merge_13)
edges = BrepEdges(Brep=srf_6)  # -> Naked, Interior, NonManifold
len_4 = Length(Curve=edges.Naked)
sort_4 = SortList(Keys=len_4, ValuesA=edges.Naked)  # -> Keys, reverse(ValuesA)
item_12 = ListItem(List=sort_4.ValuesA, Index=0, Wrap=True)  # -> Item, Item1
flip_2 = FlipCurve(Curve=item_12.Item1)  # -> Curve, Flag
merge_14 = Merge(Data1=item_12.Item, Data2=flip_2.Curve)
divide_2 = DivideCurve(Curve=merge_14, Count=Slider(100, range=0..100), Kinks=False)  # -> Points, Tangents, Parameters
path_mapper_14 = PathMapper(divide_2.Points, source="{A;B;C}(i)", target="{A;B;i}(C)")
item_13 = ListItem(List=path_mapper_14, Index=0, Wrap=True)  # -> Item, Item1
dist = Distance(PointA=item_13.Item, PointB=item_13.Item1)
trim_5 = TrimTree(Tree=dist, Depth=1)
bnd_10 = Bounds(Numbers=trim_5)
dedomain_13 = DeconstructDomain(Domain=bnd_10)  # -> simplify(Start), End
multiplication_7 = Multiplication(A=dedomain_13.Start, B=Slider(0.95, range=0..1))  # -> flatten(Result)
c_script_6 = CSharpScript(x=multiplication_7)  # -> out, A; inputs x: list of Double
# ---------- c_script_6: C# ----------
    List<double> output = new List<double>();
    
    double currentVal = 0;
    for(int i = 0; i < x.Count; i++)
    {
      output.Add(currentVal);
      currentVal += x[i];
    }
    A = output;
# ---------- end c_script_6 ----------
Y_15 = UnitY(Factor=c_script_6.A)
move_20 = Move(Geometry=srf_6, Motion=Y_15)  # -> Geometry, Transform

relaxation_2 = Panel(bnd_8)

mesh_5 = Mesh(mesh_3)
c_script_7 = CSharpScript(mesh=mesh_5, surface=srf_3)  # -> out, Curvature; inputs mesh: Mesh, surface: Surface
# ---------- c_script_7: C# ----------
        //get surface gaussian curvature at each mesh point
        List<double> gaussianCurvatures = new List<double>();
        double maxGaussian = 0;
        double minGaussian = double.MaxValue;

        double U;
        double V;

        for (int i = 0; i < mesh.Vertices.Count; i++)
        {
            Point3d currentMeshPoint = mesh.Vertices.Point3dAt(i);
            surface.ClosestPoint(currentMeshPoint, out U, out V);
            SurfaceCurvature surfaceCurvature = surface.CurvatureAt(U, V);
            double gaussian = surfaceCurvature.Gaussian;
            gaussianCurvatures.Add(gaussian);

            //get the range of curvatures
            if (gaussian > maxGaussian) maxGaussian = gaussian;
            if( gaussian < minGaussian) minGaussian = gaussian;
        }


        //get the range of curvatures


        //remap the curvatures to color values on the mesh points
        for (int i = 0; i < mesh.Vertices.Count; i++)
        {
            double hue = (gaussianCurvatures[i] - minGaussian) / (0 - minGaussian) * (0.5 - maxGaussian) + maxGaussian;
        }
        Curvature = gaussianCurvatures;
# ---------- end c_script_7 ----------
mesh_6 = Mesh(flatten(mesh_5))
num_24 = Number(c_script_7.Curvature)
bnd_11 = Bounds(Numbers=num_24)
dedomain_14 = DeconstructDomain(Domain=bnd_11)  # -> Start, End
gradient_7 = Gradient(
    LowerLimit=dedomain_14.Start,
    UpperLimit=dedomain_14.End,
    Parameter=num_24,
    stops=[0: RGB(0, 128, 0), 0.5: RGB(255, 255, 0), 1: RGB(255, 0, 0)])
number_slider_8 = Slider(7456, range=0..10000)
X_3 = UnitX(Factor=number_slider_8)

gaussian_curvature = Panel(bnd_11)

move_21 = Move(Geometry=mesh_6, Motion=Y_15)  # -> simplify(graft(Geometry)), Transform

mesh_7 = Mesh(move_21.Geometry)

move_22 = Move(Geometry=mesh_7, Motion=Y_12)  # -> Geometry, Transform

move_23 = Move(Geometry=move_22.Geometry, Motion=X_3)  # -> Geometry, Transform
c_script_8 = CSharpScript(mesh=move_23.Geometry, colors=simplify(gradient_7))  # -> out, A; inputs mesh: Mesh, colors: list of Color
# ---------- c_script_8: C# ----------
    for(int i = 0; i < mesh.Vertices.Count; i++)
    {
      mesh.VertexColors.SetColor(i, colors[i]);
    }
    A = mesh;
# ---------- end c_script_8 ----------

srf_7 = Surface(reparameterize(simplify(graft(merge_13))))
crv_15 = Curve(dec_reg_4.Polyline)
explode_8 = Explode(Curve=crv_15, Recursive=True)  # -> Segments, Vertices
len_5 = Length(Curve=explode_8.Segments)
path_mapper_15 = PathMapper(crv_15, source=["{A;B}", "{A}", "{A;B;C}"], target=["{A}", "{0}", "{A}"])
division_3 = Division(A=len_5, B=Slider(100, range=0..100))
runion = RegionUnion(Curves=path_mapper_15)
divide_3 = DivideCurve(Curve=explode_8.Segments, Count=division_3, Kinks=False)  # -> Points, Tangents, Parameters
path_mapper_16 = PathMapper(divide_3.Points, source=["{A;B;C;D}", "{A;B;C}", "{A;B;C;D;E}"], target=["{A}", "{0}", "{A}"])
srf_8 = Surface(reparameterize(simplify(runion)))
srf_cp = SurfaceClosestPoint(Point=path_mapper_16, Surface=srf_8)  # -> Point, UVPoint, Distance

c_script_9 = CSharpScript(x=srf_cp.UVPoint)  # -> out, A; inputs x: Point3d
# ---------- c_script_9: C# ----------
    A = new Point3d(x.Y, x.X, x.Z);
# ---------- end c_script_9 ----------

evalsrf = EvaluateSurface(Surface=reparameterize(srf_7), Point=c_script_9.A)  # -> Point, Normal, UDirection, VDirection, Frame
c_script_10 = CSharpScript(trimmedTree=evalsrf.Point, originalTree=divide_3.Points)  # -> out, A; inputs trimmedTree: tree, originalTree: tree
# ---------- c_script_10: C# ----------
    if(originalTree.DataCount != trimmedTree.DataCount) Component.AddRuntimeMessage(GH_RuntimeMessageLevel.Error, "Number of items in both trees must be equal");

    DataTree<object> outputs = new DataTree<object>();
    List<GH_Path> paths = GetPaths(originalTree);
    //step through trimmed tree objects and add them to output tree with the correct

    int counter = 0;
    for(int i = 0; i < trimmedTree.BranchCount; i++)
    {
      for(int j = 0; j < trimmedTree.Branch(i).Count; j++)
      {
        outputs.Add(trimmedTree.Branch(i)[j], paths[counter]);
        counter++;
      }
    }
    A = outputs;
# ---------- c_script_10: C# additional code ----------
  public List<GH_Path> GetPaths(DataTree<object> originalTree)
  {
    List<GH_Path> output = new List<GH_Path>();
    for(int i = 0; i < originalTree.BranchCount; i++)
    {
      for(int j = 0; j < originalTree.Branch(i).Count; j++)
      {
        output.Add(originalTree.Paths[i]);
      }
    }
    return output;
  }
# ---------- end c_script_10 ----------
intcrv_6 = Interpolate(Vertices=c_script_10.A, Degree=3, Periodic=False, KnotStyle=1)  # -> Curve, Length, Domain
trim_6 = TrimTree(Tree=intcrv_6.Curve, Depth=1)
join_6 = JoinCurves(Curves=trim_6, Preserve=False)  # -> simplify(Curves)
path_mapper_17 = PathMapper(join_6, source=["{A;B;C}", "{A;B}", "{A;B;C;D}"], target=["{A}", "{0}", "{A}"])
lng_12 = ListLength(List=path_mapper_17)
dup_6 = DuplicateData(Data=srf_7, Number=lng_12, Order=True)
srfsplit = SurfaceSplit(Surface=simplify(graft(dup_6)), Curves=simplify(graft(path_mapper_17)))  # -> simplify(Fragments)
area_6 = Area(Geometry=srfsplit)  # -> Area, Centroid
sort_5 = SortList(Keys=area_6.Area, ValuesA=srfsplit)  # -> Keys, reverse(ValuesA)
item_14 = ListItem(List=sort_5.ValuesA, Index=Slider(1, range=0..1), Wrap=True)

path_mapper_18 = PathMapper(item_14, source=["{A}", "{A;B}"], target=["{0}", "{A}"])

c_script_11 = CSharpScript(trimmedTree=path_mapper_18, originalTree=join_6)  # -> out, A; inputs trimmedTree: tree, originalTree: tree; same code as c_script_10

trim_7 = TrimTree(Tree=c_script_11.A, Depth=2)
join_7 = BrepJoin(Breps=trim_7)  # -> Breps, Closed
trim_8 = TrimTree(Tree=join_7.Breps, Depth=1)
item_15 = ListItem(List=trim_8, Index=0, Wrap=True)  # -> flatten(Item)
move_24 = Move(Geometry=item_15, Motion=Y_15)  # -> simplify(graft(Geometry)), Transform

srf_9 = Surface(move_20.Geometry)
number_slider_9 = Slider(30, range=0..100)

flip_3 = FlipMatrix(Data=srf_9)
item_16 = ListItem(List=flip_3, Index=0, Wrap=True)

shift_2 = ShiftList(List=item_16, Shift=1, Wrap=True)
shift_3 = ShiftList(List=item_16, Shift=-1, Wrap=True)
bbx = BrepBrep(BrepA=item_16, BrepB=shift_3)  # -> Curves, Points
bbx_2 = BrepBrep(BrepA=item_16, BrepB=shift_2)  # -> Curves, Points
merge_15 = Merge(Data1=bbx_2.Curves, Data2=bbx.Curves)  # -> simplify(Result)
srf_10 = Surface(simplify(graft(item_16)))
ext = ExtendCurve(Curve=merge_15, Type=0, Start=number_slider_9, End=number_slider_9)
srfsplit_2 = SurfaceSplit(Surface=srf_10, Curves=ext)  # -> simplify(Fragments)
area_7 = Area(Geometry=srfsplit_2)  # -> Area, Centroid
area_8 = Area(Geometry=srf_10)  # -> Area, Centroid
dist_2 = Distance(PointA=area_8.Centroid, PointB=area_7.Centroid)
sort_6 = SortList(Keys=dist_2, ValuesA=srfsplit_2)  # -> Keys, ValuesA
item_17 = ListItem(List=sort_6.ValuesA, Index=0, Wrap=True)  # -> flatten(Item)

clean_2 = CleanTree(RemoveNulls=True, RemoveInvalid=True, RemoveEmpty=False, Tree=item_17)
srf_11 = Surface(clean_2)

item_18 = ListItem(List=srf_11, Index=1, Wrap=True)
item_19 = ListItem(List=srf_11, Index=0, Wrap=True)
number_slider_10 = Slider(1000, range=0..1000)
bbx_3 = BrepBrep(BrepA=item_19, BrepB=item_18)  # -> Curves, Points
ext_2 = ExtendCurve(Curve=bbx_3.Curves, Type=0, Start=number_slider_10, End=number_slider_10)
Y_16 = UnitY(Factor=Slider(10000, range=0..10000))
neg_8 = Negative(Value=Y_16)
extr = Extrude(Base=ext_2, Direction=neg_8)
split = SplitBrep(Brep=item_19, Cutter=extr)
area_9 = Area(Geometry=split)  # -> Area, Centroid
pdecon_11 = Deconstruct(Point=area_9.Centroid)  # -> XComponent, YComponent, ZComponent
sort_7 = SortList(Keys=pdecon_11.ZComponent, ValuesA=split)  # -> Keys, reverse(ValuesA)
item_20 = ListItem(List=sort_7.ValuesA, Index=0, Wrap=True)

item_21 = ListItem(List=reverse(srf_11), Index=0, Wrap=True)
item_22 = ListItem(List=reverse(srf_11), Index=1, Wrap=True)
number_slider_11 = Slider(1000, range=0..1000)
bbx_4 = BrepBrep(BrepA=item_21, BrepB=item_22)  # -> Curves, Points
ext_3 = ExtendCurve(Curve=bbx_4.Curves, Type=0, Start=number_slider_11, End=number_slider_11)
Y_17 = UnitY(Factor=Slider(10000, range=0..10000))
extr_2 = Extrude(Base=ext_3, Direction=Y_17)
split_2 = SplitBrep(Brep=item_21, Cutter=extr_2)
area_10 = Area(Geometry=split_2)  # -> Area, Centroid
pdecon_12 = Deconstruct(Point=area_10.Centroid)  # -> XComponent, YComponent, ZComponent
sort_8 = SortList(Keys=pdecon_12.ZComponent, ValuesA=split_2)  # -> Keys, reverse(ValuesA)
item_23 = ListItem(List=sort_8.ValuesA, Index=0, Wrap=True)

srf_12 = Surface(srf_11)
lng_13 = ListLength(List=srf_12)
dom_14 = ConstructDomain(DomainStart=1, DomainEnd=expr("x-2", lng_13))
larger = LargerThan(FirstNumber=lng_13, SecondNumber=2)  # -> LargerThan, OrEqualTo
subset_10 = SubList(List=srf_12, Domain=dom_14, Wrap=True)  # -> List, Index
cull_10 = CullPattern(List=subset_10.List, CullPattern=larger.LargerThan)

merge_16 = Merge(Data1=flatten(item_20), Data2=flatten(cull_10), Data3=flatten(item_23))

# ---- group: mesh
mesh_breps = MeshBrepsKaramba3D(
    Brep=merge_16,
    MeshResolution=Slider(150, range=0..200),
    EdgeRefinementFactor=0.67,
    PointReduction=False,
    SmoothingStepSize=0,
    SmoothingIterations=5)  # -> Mesh, Info
mesh_8 = Mesh(simplify(graft(mesh_breps.Mesh)))

# ----
data_12 = Data(cull_6)
data_13 = Data(species_3)
dec_panel_buildups = DeconstructPanelBuildup(Panels=data_12)  # -> WoodSpecies, Thicknesses
tstat = TreeStatistics(Tree=dec_panel_buildups.Thicknesses)  # -> Paths, Length, Count
lng_14 = ListLength(List=tstat.Paths)
dup_7 = DuplicateData(Data=data_13, Number=lng_14, Order=True)  # -> graft(Data)
dup_8 = DuplicateData(Data="4", Number=lng_14, Order=True)  # -> graft(Data)
match = MatchTree(Tree=dup_7, Guide=dec_panel_buildups.WoodSpecies)
match_2 = MatchTree(Tree=dup_8, Guide=dec_panel_buildups.Thicknesses)
merge_17 = Merge(Data1=dec_panel_buildups.WoodSpecies, Data2=match)
merge_18 = Merge(Data1=dec_panel_buildups.Thicknesses, Data2=match_2)

# ---- group: thicknesses
num_25 = Number(merge_18)

# ---- group: species
data_14 = Data(merge_17)

# ----
c_script_12 = CSharpScript(x=num_25)  # -> out, A; inputs x: tree
# ---------- c_script_12: C# ----------
    DataTree<object> output = new DataTree<object>();
    int firstIndex = 0;
    int branchCount = 0;
    for(int i = 0; i < x.BranchCount; i++)
    {
      GH_Path path = new GH_Path(firstIndex, branchCount);
      if(x.Paths[i][0] == firstIndex)
      {
        output.AddRange(x.Branch(i), path);
      }
      else
      {
        firstIndex++;
        branchCount = -1;
        i--;
      }
      branchCount++;
    }
    A = output;
# ---------- end c_script_12 ----------
c_script_13 = CSharpScript(x=data_14)  # -> out, A; inputs x: tree; same code as c_script_12

# ---- group: brep to mesh order
c_script_14 = CSharpScript(
    meshes=mesh_8,
    breps=move_24.Geometry,
    species=c_script_13.A,
    thicknesses=c_script_12.A,
    Reference="C:\Users\Alex Reiner\AppData\Roaming\Grasshopper\Libraries\HygroDesign.Core.dll")  # -> out, meshSpecies, meshThicknesses; inputs meshes: tree of Mesh, breps: tree of Brep, species: tree, thicknesses: tree of Double
# ---------- c_script_14: C# usings ----------
using Rhino.Geometry.Collections;
using BilayerDesign;
# ---------- c_script_14: C# ----------
    DataTree<Species> faceSpecies = new DataTree<Species>();
    DataTree<double> faceThicknesses = new DataTree<double>();

    //for each mesh face, find face index of closest point
    for(int j = 0; j < meshes.BranchCount; j++)
    {
      Mesh mesh = meshes.Branch(j)[0];
      MeshFaceList faceList = mesh.Faces;
      for(int i = 0; i < faceList.Count; i++)
      {
        Point3d centroid = faceList.GetFaceCenter(i);

        Point3d closestPoint;
        ComponentIndex ci;
        double s;
        double t;
        Vector3d normal;
        breps.Branch(j)[0].ClosestPoint(centroid, out closestPoint, out ci, out s, out t, 100, out normal);


        
        List<Species> speciesList = new List<Species>();
        foreach(Species thisSpecies in species.Branch(new GH_Path(j, ci.Index)))
        {
          speciesList.Add(thisSpecies);
        }
        
        List<double> thicknessList = new List<double>();
        foreach(double thisThickness in thicknesses.Branch(new GH_Path(j, ci.Index)))
        {
          thicknessList.Add(thisThickness);
        }

        faceSpecies.AddRange(speciesList, new GH_Path(j, i));

        faceThicknesses.AddRange(thicknessList, new GH_Path(j, i));
 

      }
    }




    //return list of materials for each face
    meshSpecies = faceSpecies;
    meshThicknesses = faceThicknesses;
# ---------- end c_script_14 ----------

# ---- group: display mesh thickness
lng_15 = ListLength(List=c_script_14.meshSpecies)
trim_9 = TrimTree(Tree=lng_15, Depth=1)
bnd_12 = Bounds(Numbers=flatten(trim_9))
dedomain_15 = DeconstructDomain(Domain=bnd_12)  # -> Start, End
gradient_8 = Gradient(
    LowerLimit=dedomain_15.Start,
    UpperLimit=dedomain_15.End,
    Parameter=trim_9,
    stops=[0: RGB(212, 212, 212), 1: RGB(0, 0, 0)])
X_4 = UnitX(Factor=number_slider_8)
move_25 = Move(Geometry=mesh_8, Motion=X_4)  # -> Geometry, Transform
facen = FaceNormals(Mesh=move_25.Geometry)  # -> Centers, Normals
preview_9 = CustomPreview(Geometry=facen.Centers, Material=gradient_8)

# ---- group: species
data_15 = Data(c_script_14.meshSpecies)

# ----
dec_secies = DeconstructSpecies(Species=data_15)  # -> N, LX, RX, TX, LE, RE, TE

# ---- group: thicknesses
data_16 = Data(c_script_14.meshThicknesses)
