# Grasshopper definition Object Oriented Bilayers.gh (Grasshopper 1.0.7)
# plug-ins: sof_gh_sofistik-2022, HygroDesign

io = IO(
    SofistikDocumentProperties_VersionMajor="2022",
    SofistikDocumentProperties_VersionMinor="0",
    SofistikDocumentProperties_VersionName="2022")
number_slider = Slider(1000, range=0..1000)
update = Button()
xy = XYPlane(Origin=Point(0, 0, 0))
python = GhPythonScript(update=update)  # inputs update: Boolean
# ---------- python: Python ----------
# Seghier Mohamed Abdelaziz - 2021 - seghierdesign@gmail.com

import Grasshopper as gh

ghDoc = ghenv.Component.OnPingDocument()
objects = ghDoc.Objects

object = []

for obj in objects: 

    if obj.NickName.Length == 0:
        if str(obj.RemovedFromDocument.DeclaringType) == "Grasshopper.Kernel.GH_Component":
            object.append(obj)
                
if update == True:
    gh.Kernel.GH_Document.NewSolution(ghDoc,False)
    for o in object:
        gh.Kernel.GH_Document.RemoveObject(ghDoc ,o,False)
# ---------- end python ----------
panel = BilayerPanel(
    BasePlane=xy,
    BoardWidth=Slider(100, range=0..100),
    BoardLength=number_slider,
    WidthCount=Slider(9, range=0..10),
    LengthCount=Slider(4, range=0..10))
species = WoodSpecies()
board_count = Slider(100, range=0..100)
item = ListItem(List=species, Index=0, Wrap=True)  # -> Item, Item1
deconstruct_panel = DeconstructPanel(Panel=panel)

# ---- group: spruce
data = Data(item.Item1)

# ---- group: beech
data_2 = Data(item.Item)

# ----
dec_board = DeconstructBoard(Board=deconstruct_panel)  # -> Name, Polyline, Radius, MoistureChange, Error
area = Area(Geometry=dec_board.Polyline)  # -> Area, Centroid

# ---- group: desired radius
pt = Point(area.Centroid)
pdecon = Deconstruct(Point=pt)  # -> XComponent, YComponent, ZComponent
bnd = Bounds(Numbers=flatten(pdecon.XComponent))
dom = ConstructDomain(DomainStart=Slider(253, range=0..1000), DomainEnd=Slider(1242, range=0..10000))
remap = RemapNumbers(Value=pdecon.XComponent, Source=bnd, Target=dom)  # -> Mapped, Clipped

# ---- group: calculate weights
pt_2 = Point(area.Centroid)
avr = Average(Input=flatten(pt_2))
pdecon_2 = Deconstruct(Point=pt_2)  # -> XComponent, YComponent, ZComponent
pdecon_3 = Deconstruct(Point=avr)  # -> XComponent, YComponent, ZComponent
subtraction = Subtraction(A=pdecon_2.XComponent, B=pdecon_3.XComponent)
abs = Absolute(Value=subtraction)
bnd_2 = Bounds(Numbers=flatten(abs))
dom_2 = ConstructDomain(DomainStart=Slider(0, range=0..1000), DomainEnd=Slider(1, range=0..10))
remap_2 = RemapNumbers(Value=abs, Source=bnd_2, Target=dom_2)  # -> Mapped, Clipped

# ---- group: material goals / beech
data_3 = Data(data_2)

# ---- group: material goals / spruce
data_4 = Data(data)

# ---- group: material goals
pt_3 = Point(area.Centroid)
pdecon_4 = Deconstruct(Point=pt_3)  # -> XComponent, YComponent, ZComponent
avr_2 = Average(Input=flatten(pdecon_4.XComponent))
smaller = SmallerThan(FirstNumber=pdecon_4.XComponent, SecondNumber=avr_2)  # -> SmallerThan, OrEqualTo
lng = ListLength(List=flatten(smaller.SmallerThan))
lng_2 = ListLength(List=smaller.SmallerThan)  # -> flatten(Length)
dup = DuplicateData(Data=data_4, Number=lng, Order=True)
dup_2 = DuplicateData(Data=data_3, Number=lng, Order=True)
partition = PartitionList(List=dup, Size=lng_2)  # -> simplify(Chunks)
partition_2 = PartitionList(List=dup_2, Size=lng_2)  # -> simplify(Chunks)
not = GateNot(A=smaller.SmallerThan)
cull = CullPattern(List=partition, CullPattern=not)
cull_2 = CullPattern(List=partition_2, CullPattern=smaller.SmallerThan)
merge = Merge(Data1=cull_2, Data2=cull)

# ---- group: name
num = Number(board_count)
series = Series(Start=0, Step=1, Count=num)
dup_3 = DuplicateData(Data="S", Number=num, Order=True)  # -> graft(Data)
txt = Text(graft(series))
merge_2 = Merge(Data1=dup_3, Data2=txt)  # -> simplify(Result)
join = TextJoin(Text=merge_2)  # -> flatten(Result)

# ---- group: RT
dom_3 = ConstructDomain(DomainStart=Slider(11, range=0..100), DomainEnd=Slider(75, range=0..100))
random = Random(Range=dom_3, Number=board_count, Seed=Slider(225, range=0..1000))

dom_4 = ConstructDomain(DomainStart=Slider(15, range=0..100), DomainEnd=Slider(75, range=0..100))
random_2 = Random(Range=dom_4, Number=board_count, Seed=Slider(225, range=0..1000))

# ---- group: name
num_2 = Number(board_count)
series_2 = Series(Start=0, Step=1, Count=num_2)
dup_4 = DuplicateData(Data="B", Number=num_2, Order=True)  # -> graft(Data)
txt_2 = Text(graft(series_2))
merge_3 = Merge(Data1=dup_4, Data2=txt_2)  # -> simplify(Result)
join_2 = TextJoin(Text=merge_3)  # -> flatten(Result)

# ---- group: length
num_3 = Number(number_slider)
num_4 = Number(board_count)
dup_5 = DuplicateData(Data=num_3, Number=num_4, Order=True)

num_5 = Number(number_slider)
num_6 = Number(board_count)
dup_6 = DuplicateData(Data=num_5, Number=num_6, Order=True)

# ---- group: moisture changes
panel_2 = Panel("""5
10
15""")
num_7 = Number(panel_2)

# ----
stockpile = Stockpile(Material=data, Name=join, Length=dup_6, RTAngle=random_2, MoistureChanges=num_7)
stockpile_2 = Stockpile(Material=data_2, Name=join_2, Length=dup_5, RTAngle=random, MoistureChanges=num_7)
update_panel = UpdatePanel(Panel=panel, Radius=remap.Mapped, RadiusWeight=remap_2.Mapped, Material=merge, MaterialWeight=remap_2.Mapped)
merge_4 = Merge(Data1=stockpile_2, Data2=stockpile)
design_env = DesignEnvironment(Panels=update_panel, Stockpile=merge_4)  # -> Panels, Stockpiles
deconstruct_panel_2 = DeconstructPanel(Panel=design_env.Panels)
c_script = CSharpScript()  # -> out, surfaces, weightedAverages, selectedWeights; inputs boards: tree of Surface, initialPrediction: tree of Double, boardStiffness: tree of Double, tangentialBlend: Double, longitudinalBlend: Double, displayCol: Int32, displayRow: Int32
# ---------- c_script: C# ----------
    int rowCount = initialPrediction.BranchCount;
    int columnCount = initialPrediction.Branch(0).Count;



    //create 2d arrays
    double[,] prediction = new double[columnCount, rowCount];
    double[,] stiffness = new double[columnCount, rowCount];

    //fill arrays and get bounds
    double minStiffness = double.MaxValue;
    double minRad = double.MaxValue;
    double maxRad = 0;

    for(int j = 0; j < initialPrediction.BranchCount; j++)
    {
      for(int i = 0; i < initialPrediction.Branch(j).Count; i++)
      {
        prediction[i, j] = initialPrediction.Branch(j)[i];
        stiffness[i, j] = boardStiffness.Branch(j)[i];

        if(stiffness[i, j] < minStiffness)minStiffness = stiffness[i, j];
        if(prediction[i, j] < minRad)minRad = prediction[i, j];
        if(prediction[i, j] > maxRad)maxRad = prediction[i, j];
      }
    }
    Tuple<double,double> radBounds = new Tuple<double,double>(minRad, 20000.0);

    //scale min stiffness to 1 and max stiffness proportionally
    for(int i = 0; i < columnCount; i++)
    {
      for(int j = 0; j < rowCount; j++)
      {
        stiffness[i, j] /= minStiffness;
      }
    }

    //create convolution results array
    Tuple<double,double>[,] predictionBlend = new Tuple<double,double>[columnCount, rowCount];

    //perform convolution
    for(int i = 0;  i < columnCount; i++)
    {
      for(int j = 0; j < rowCount; j++)
      {
        predictionBlend[i, j] = Convolution(i, j, prediction, radBounds, stiffness, tangentialBlend, longitudinalBlend, columnCount, rowCount);
      }
    }

    //create output tree
    DataTree<double> output = new DataTree<double>();
    for(int i = 0;  i < columnCount; i++)
    {
      for(int j = 0; j < rowCount; j++)
      {
        output.Add(predictionBlend[i, j].Item1, new GH_Path(j, i));
        output.Add(predictionBlend[i, j].Item2, new GH_Path(j, i));
      }
    }
    weightedAverages = output;

    //output weights for selected board's convolution
    selectedWeights = ConvolutionWeights(displayCol, displayRow, prediction, radBounds, stiffness, tangentialBlend, longitudinalBlend, columnCount, rowCount);

    //output display surfaces
    DataTree<Surface> surfaceOutput = new DataTree<Surface>();
    for(int i = 0; i < boards.BranchCount; i++)
    {
      for(int j = 0; j < boards.Branch(i).Count; j++)
      {
        if(i == displayRow)surfaceOutput.Add(boards.Branch(i)[j], new GH_Path(1));
        if(j == displayCol)surfaceOutput.Add(boards.Branch(i)[j], new GH_Path(0));
      }
    }
    surfaces = surfaceOutput;
# ---------- c_script: C# additional code ----------
  public Tuple<double,double> Convolution(int colNum, int rowNum, double[,] array, Tuple<double,double> radBounds, double[,] stiffness, double tanBlend, double longBlend, int cols, int rows)
  {
    //calculate column weights
    double[] colWeights = new double[rows];
    for(int row = 0; row < rows; row++)
    {
      double radiusFactor = Math.Pow(Remap(array[colNum, row], radBounds.Item1, radBounds.Item2, 1, 0), 2);
      colWeights[row] = radiusFactor / Math.Pow((Math.Abs(row - rowNum) + 1) / stiffness[colNum, row], longBlend);
    }

    //calculate row weights
    double[] rowWeights = new double[cols];
    for(int col = 0; col < cols; col++)
    {
      double radiusFactor = Math.Pow(Remap(array[col, rowNum], radBounds.Item1, radBounds.Item2, 1, 0), 2);
      rowWeights[col] = radiusFactor / Math.Pow((Math.Abs(col - colNum) + 1) / stiffness[col, rowNum], tanBlend);
    }

    //calculate weighted averages col
    double totalValuesCol = 0;
    double totalWeightsCol = 0;
    for(int row = 0; row < rows; row++)
    {
      totalValuesCol += array[colNum, row] * colWeights[row];
      totalWeightsCol += colWeights[row];
    }
    double weightedColVal = totalValuesCol / totalWeightsCol;

    //calculate weighted averages row
    double totalValuesRow = 0;
    double totalWeightsRow = 0;
    for(int col = 0; col < cols; col++)
    {
      totalValuesRow += array[col, rowNum] * rowWeights[col];
      totalWeightsRow += rowWeights[col];
    }
    double weightedRowVal = totalValuesRow / totalWeightsRow;

    return new Tuple<double,double>(weightedColVal, weightedRowVal);
  }




  public DataTree<double> ConvolutionWeights(int colNum, int rowNum, double[,] array, Tuple<double,double> radBounds, double[,] stiffness, double tanBlend, double longBlend, int cols, int rows)
  {
    //calculate column weights
    double[] colWeights = new double[rows];
    double[] colDistance = new double[rows];
    double[] colStiffness = new double[rows];
    double[] colRadFact = new double[rows];

    for(int row = 0; row < rows; row++)
    {
      double radiusFactor = Math.Pow(Remap(array[colNum, row], radBounds.Item1, radBounds.Item2, 1, 0), 2);
      colWeights[row] = radiusFactor / Math.Pow((Math.Abs(row - rowNum) + 1) / stiffness[colNum, row], longBlend);

      //record varius factors
      colDistance[row] = Math.Abs(row - rowNum) + 1;
      colStiffness[row] = stiffness[colNum, row];
      colRadFact[row] = radiusFactor;
    }

    //calculate row weights
    double[] rowWeights = new double[cols];
    double[] rowDistance = new double[cols];
    double[] rowStiffness = new double[cols];
    double[] rowRadFact = new double[cols];

    for(int col = 0; col < cols; col++)
    {
      double radiusFactor = Math.Pow(Remap(array[col, rowNum], radBounds.Item1, radBounds.Item2, 1, 0), 2);
      rowWeights[col] = radiusFactor / Math.Pow((Math.Abs(col - colNum) + 1) / stiffness[col, rowNum], tanBlend);

      //record varius factors
      rowDistance[col] = Math.Abs(col - colNum) + 1;
      rowStiffness[col] = stiffness[col, rowNum];
      rowRadFact[col] = radiusFactor;
    }

    //output weights
    DataTree<double> output = new DataTree<double>();
    foreach(double val in colWeights)output.Add(val, new GH_Path(0, 0));
    foreach(double val in colDistance)output.Add(val, new GH_Path(0, 1));
    foreach(double val in colStiffness)output.Add(val, new GH_Path(0, 2));
    foreach(double val in colRadFact)output.Add(val, new GH_Path(0, 3));

    foreach(double val in rowWeights)output.Add(val, new GH_Path(1, 0));
    foreach(double val in rowDistance)output.Add(val, new GH_Path(1, 1));
    foreach(double val in rowStiffness)output.Add(val, new GH_Path(1, 2));
    foreach(double val in rowRadFact)output.Add(val, new GH_Path(1, 3));
    return output;
  }



  public double Remap (double val, double from1, double to1, double from2, double to2) {
    return (val - from1) / (to1 - from1) * (to2 - from2) + from2;
  }
# ---------- end c_script ----------
dec_board_2 = DeconstructBoard(Board=deconstruct_panel_2)  # -> Name, Polyline, Radius, MoistureChange, Error
bnd_3 = Bounds(Numbers=flatten(dec_board_2.Radius))
srf = Surface(dec_board_2.Polyline)
dedomain = DeconstructDomain(Domain=bnd_3)  # -> Start, End
gradient = Gradient(
    LowerLimit=dedomain.Start,
    UpperLimit=dedomain.End,
    Parameter=dec_board_2.Radius,
    stops=[0: RGB(0, 128, 0), 0.5: RGB(255, 255, 0), 1: RGB(255, 0, 0)])
preview = CustomPreview(Geometry=srf, Material=gradient)
